# Grasshopper definition Generator_04_12.gh (Grasshopper 1.0.7)
# Copyright: 2019

# ---- group: AREA DISTRIBIUTION OF THE SITE
# 1- FORM GENERATOR
site = Curve(<curve referenced from the Rhino model>)
pop2d = Populate2D(Region=site, Count=Slider(250, range=250..500), Seed=1)
panel = Panel("""25
15
30""")
space_distrbutor = GhPythonScript(prg_prc=panel)  # -> out, Residential_area, Retail_area, Office_area; inputs prg_typs: list, prg_prc: list of Int32
# ---------- space_distrbutor: Python ----------
__author__ = "milad"
__version__ = "2019.03.18"

import rhinoscriptsyntax as rs

t=0
if (len(prg_typs) == len(prg_prc)):
    for i in range(len(prg_prc)):
        t = t+ prg_prc[i]
    if(t<=70):
        Residential_area = site_area*float(prg_prc[0]/100)
        Retail_area = site_area*float(prg_prc[1]/100)
        Office_area = site_area*float(prg_prc[2]/100)
# ---------- end space_distrbutor ----------

area = Area(Geometry=site)  # -> Area, Centroid
panel_2 = Panel(area.Area)

# ----
panel_3 = Panel([Slider(30, range=0..100), Slider(15, range=0..100), Slider(40, range=0..100), Slider(15, range=0..100)])
panel_4 = Panel([Slider(14, range=12..18), Slider(15, range=12..18), Slider(12, range=12..18), Slider(15, range=12..18)])
panel_5 = Panel("""office
public
residential
retail""")
the_context = Brep([<brep referenced from the Rhino model> x136])
giraffe = GhPythonScript(
    on_off=Toggle(False),
    const_perc="40",
    site_prem=site,
    input_context=the_context,
    context_range=Slider(250, range=0..1000),
    input_pts=pop2d,
    num_corners="7",
    programs=panel_5,
    total_floor_num=Slider(60, range=0..100),
    seed=Slider(1, range=1..15),
    prg_percentage=panel_3,
    prg_heights=panel_4)  # -> out, site_area, site_center, immediate_context, floor_pts, ret, ofc, res; inputs input_context: list, input_pts: list, programs: list, total_floor_num: Int32, seed: Int32, prg_percentage: list of Int32, prg_heights: list
# ---------- giraffe: Python ----------
__author__ = "milad"
__version__ = "2019.04.05"

import rhinoscriptsyntax as rs
import ghpythonlib.components as gh

ret = []
ofc = []
res = []
floor_retail_outlines = []
floor_residential_outlines = []
floor_public_outlines = []
floor_office_outlines = []

floor_pts = []
index = []

#Site Information
site_area = rs.CurveArea(site_prem)[0]
site_center = rs.CurveAreaCentroid(site_prem)[0]


#Context : Get the information from the context
def closestBreps(breps,crv):
    ref = context_range
    i=0
    brep_centers = []
    sorted_breps = []
    closest_breps =[]
    for i in range(len(breps)):
        brep_centers.append(gh.Volume(rs.coercebrep(breps[i]))[1])
    i=0
    for i in range(len(breps)):
        distance = rs.Distance(gh.Area(rs.coercebrep(breps[i]))[1],rs.CurveAreaCentroid(crv)[0])
        if (distance <= ref):
            index = i
            sorted_breps.append(breps[i])
    i=0
    for i in range(len(sorted_breps)):
        closest_breps.append(sorted_breps[len(sorted_breps)-1-i])
    return closest_breps

immediate_context = closestBreps(input_context,site_prem)


#Tower: Random Floor Generator

def rndm(num_rndms,seed_num):
    seeds = []
    seeds.extend(gh.Random(len(input_pts),num_rndms,seed_num))
    i=0
    for i in range(len(seeds)):
        seeds[i] = int(seeds[i])
    return seeds

def punch(curves,force):
    in_curve_pts = []
    context_centers = []
    context = []
    i=0
    j=0
    _distance = 0
    in_curve_pts.append(rs.CurvePoints(curves))
    for i in range(len(curves)):
        context.append(closestBreps(input_context,curves))
    i=0
    for i in range(len(context)):
        context_centers.append(gh.Volume(context[i])[1])
    i=0
    for i in range(len(context_centers)):
        for j in range(len(in_curve_pts)):
            closest_pt = rs.PointArrayClosestPoint(in_curve_pts[j],context_centers[i])
            _distance = rs.Distance(context_centers[i],closest_pt)
            vect1 =rs.VectorDotProduct(VectorCreate(context_centers[i],closest_pt),rs.CreateVector(1,1,0))
            closestrs.MoveObject(closest_pt,rs.VectorCreate(context_centers[i],closest_pt),force*distance/1000*vect1)

def pts_sorter(pts_in):

    R_sort = []
    L_sort = []
    upper_pts = []
    lower_pts = []
    sorted_pts = []
    pts_in = rs.coerce3dpointlist(pts_in)
    i=0
    j=0
    for i in range(len(pts_in)):
        for j in range(len(pts_in)):
            if gh.Deconstruct(pts_in[i])[0] > gh.Deconstruct(pts_in[j])[0]:
                temp_L = pts_in[i]
                pts_in[i] = pts_in[j]
                pts_in[j] = temp_L
    L_sort = rs.coerce3dpointlist(pts_in)
    i = 0
    j=0
    
    for i in range(len(pts_in)):
        for j in range(len(pts_in)):
            if gh.Deconstruct(pts_in[i])[0] < gh.Deconstruct(pts_in[j])[0]:
                temp_R = pts_in[i]
                pts_in[i] = pts_in[j]
                pts_in[j] = temp_R
    R_sort =rs.coerce3dpointlist(pts_in)
    
    slope = (gh.Deconstruct(L_sort[0])[1]-gh.Deconstruct(R_sort[0])[1])/(gh.Deconstruct(L_sort[1])[0]-gh.Deconstruct(R_sort[0])[0])
    i=0
    j=0
    
    for i in range(len(pts_in)):
        y = slope * (gh.Deconstruct(pts_in[i])[0]-gh.Deconstruct(pts_in[0])[0])+gh.Deconstruct(pts_in[0])[1]
        if gh.Deconstruct(pts_in[i])[1] > y:
            upper_pts.append(pts_in[i])
        else:
            lower_pts.append(pts_in[i])
            
    for i in range(len(upper_pts)):
         for j in range(len(upper_pts)):
             if gh.Deconstruct(upper_pts[i])[0] > gh.Deconstruct(upper_pts[j])[0]:
                 temp_up = upper_pts[i]
                 upper_pts[i] = upper_pts[j]
                 upper_pts[j] = temp_up
    i=0
    j=0
    
    for i in range(len(lower_pts)):
         for j in range(len(lower_pts)):
             if gh.Deconstruct(lower_pts[i])[0] < gh.Deconstruct(lower_pts[j])[0]:
                 temp_down = lower_pts[i]
                 lower_pts[i] = lower_pts[j]
                 lower_pts[j] = temp_down
    i=0
    j=0
    
    for i in range(len(upper_pts)):
        sorted_pts.append(upper_pts[i])
    i=0
    
    for i in range(len(lower_pts)):
        sorted_pts.append(lower_pts[i])
        
    return rs.coerce3dpointlist(sorted_pts)

#Floor Generator
# Distributing programs (%40 Residential %30 Office %15 Public/Rec %15 Retail)
i=0
j=0
for i in range(len(programs)):
    n_ret = int(prg_percentage[3]/100*total_floor_num)
    f_height_ret = float(prg_heights[3])
    n_ofc = int(prg_percentage[0]/100*total_floor_num)
    f_height_ofc = float(prg_heights[0])
    n_pub = int(prg_percentage[1]/100*total_floor_num)
    f_height_pub = float(prg_heights[1])
    n_res = int(prg_percentage[2]/100*total_floor_num)
    f_height_res = float(prg_heights[2])
    if programs[i] == 'retail':
        index.extend(rndm(num_corners,seed+i))
        for j in range(len(index)):
            floor_pts.append(input_pts[index[j]])
        floor_pts = pts_sorter(rs.coerceguidlist(floor_pts))
        floor_pts.append(floor_pts[0])
        floor_retail_outlines.append((rs.AddPolyline(floor_pts)))
        i=0
        for i in range(1,n_ret+1):
            floor_retail_outlines.append(rs.CopyObject(floor_retail_outlines[0],rs.CreateVector(0,0,i*f_height_ret)))
            print (gh.Deconstruct(rs.CurvePoints(floor_retail_outlines[i])[0])[2])
        i=0
        j=0
    elif programs[i] == 'office':
        index.extend(rndm(num_corners,seed+i))
        for j in range(len(index)):
            floor_pts.append(input_pts[index[j]])
        floor_pts = pts_sorter(floor_pts)
        floor_pts.append(floor_pts[0])
        floor_office_outlines.append((rs.AddPolyline(floor_pts)))
        i=0
        for i in range(1,n_ofc+1):
            floor_office_outlines.append(rs.CopyObject(floor_office_outlines[0],rs.CreateVector(0,0,i*f_height_ofc)))
        i=0
    elif programs[i] == 'residential':
        index.extend(rndm(num_corners,seed+i))
        for j in range(len(index)):
            floor_pts.append(input_pts[index[j]])
        floor_pts = pts_sorter(rs.coerceguidlist(floor_pts))
        floor_pts.append(floor_pts[0])
        floor_residential_outlines.append((rs.AddPolyline(floor_pts)))
        i=0
        for i in range(1,n_res):
            floor_residential_outlines.append(rs.CopyObject(floor_residential_outlines[0],rs.CreateVector(0,0,i*f_height_res)))
        i=0
        j=0
    elif programs[i] == 'public':

        index.extend(rndm(num_corners,seed+i))
        for j in range(len(index)):
            floor_pts.append(input_pts[index[j]])
        floor_pts = pts_sorter(rs.coerceguidlist(floor_pts))
        floor_pts.append(floor_pts[0])
        floor_public_outlines.append((rs.AddPolyline(floor_pts)))
        i=0
        for i in range(1,int(n_pub)):
            floor_public_outlines.append(rs.CopyObject(floor_public_outlines[0],rs.CreateVector(0,0,i*f_height_pub)))
        i=0
        j=0
    else:
        print("Not a valid program type!")




index.extend(rndm(7,3))

i=0
j=0
for i in range(len(floor_retail_outlines)):
    floor_retail_outlines[i]= rs.AddPolyline(rs.CurvePoints(gh.FilletDistance(rs.coercecurve(floor_retail_outlines[i]),15)))
    rs.CurveDirectionsMatch(floor_retail_outlines[0],floor_office_outlines[i])


i=0
j=0

for i in range(len(floor_office_outlines)):
    floor_office_outlines[i]= rs.AddPolyline(rs.CurvePoints(gh.FilletDistance(rs.coercecurve(floor_office_outlines[i]),15)))
    rs.MoveObject(floor_office_outlines[i],rs.CreateVector(0,0,n_ret*f_height_ret))
    rs.CurveDirectionsMatch(floor_office_outlines[0],floor_office_outlines[i])

i=0
j=0

for i in range(len(floor_residential_outlines)):
    floor_residential_outlines[i]= rs.AddPolyline(rs.CurvePoints(gh.FilletDistance(rs.coercecurve(floor_residential_outlines[i]),15)))
    rs.MoveObject(floor_residential_outlines[i],rs.CreateVector(0,0,n_ret*f_height_ret+n_ofc*f_height_ofc))
    rs.CurveDirectionsMatch(floor_residential_outlines[0],floor_residential_outlines[i])

ret.extend(floor_retail_outlines)
ofc.extend(floor_office_outlines)
res.extend(floor_residential_outlines)



#Tower: Information

print("Construction area : ")
print("Total Sqft : ")
print '\t'
print len(floor_retail_outlines)
# ---------- end giraffe ----------
panel_6 = Panel(giraffe.out)
brep = Brep(giraffe.immediate_context)
crv = Curve(giraffe.ret)
crv_2 = Curve(giraffe.ofc)
crv_3 = Curve(giraffe.res)
loft = Loft(Curves=crv, Options={Adjust=False, Closed=False, LoftEnds=0, LoftSimp=0, LoftType=0, Rebuild=10, Refit=0.01})
loft_2 = Loft(Curves=crv_3, Options={Adjust=False, Closed=False, LoftEnds=0, LoftSimp=0, LoftType=0, Rebuild=10, Refit=0.01})
loft_3 = Loft(Curves=crv_2, Options={Adjust=False, Closed=False, LoftEnds=0, LoftSimp=0, LoftType=0, Rebuild=10, Refit=0.01})
cap = CapHoles(Brep=loft)
cap_2 = CapHoles(Brep=loft_3)
cap_3 = CapHoles(Brep=loft_2)
point_sorter = Point_Sorter()

# ==== cluster Point_Sorter
input = ClusterInput()  # Unsorted points
point_sorter = GhPythonScript(input=input)  # -> out, output; inputs input: list of Point3d
# ---------- point_sorter: Python ----------
__author__ = "milad"
__version__ = "2019.04.07"

import rhinoscriptsyntax as rs
import ghpythonlib.components as gh

def pts_sorter(pts_in):

    R_sort = []
    L_sort = []
    upper_pts = []
    lower_pts = []
    sorted_pts = []
    
    for i in range(len(pts_in)):
        for j in range(len(pts_in)):
            if gh.Deconstruct(pts_in[i])[0] > gh.Deconstruct(pts_in[j])[0]:
                temp_L = pts_in[i]
                pts_in[i] = pts_in[j]
                pts_in[j] = temp_L
    L_sort = pts_in
    i = 0
    j=0
    
    for i in range(len(pts_in)):
        for j in range(len(pts_in)):
            if gh.Deconstruct(pts_in[i])[0] < gh.Deconstruct(pts_in[j])[0]:
                temp_R = pts_in[i]
                pts_in[i] = pts_in[j]
                pts_in[j] = temp_R
    R_sort = pts_in
    
    slope = (gh.Deconstruct(L_sort[0])[1]-gh.Deconstruct(R_sort[0])[1])/(gh.Deconstruct(L_sort[1])[0]-gh.Deconstruct(R_sort[0])[0])
    i=0
    j=0
    
    for i in range(len(pts_in)):
        y = slope*(gh.Deconstruct(pts_in[i])[0]-gh.Deconstruct(pts_in[0])[0])+gh.Deconstruct(pts_in[0])[1]
        if gh.Deconstruct(pts_in[i])[1] > y:
            upper_pts.append(pts_in[i])
        else:
            lower_pts.append(pts_in[i])
            
    for i in range(len(upper_pts)):
         for j in range(len(upper_pts)):
             if gh.Deconstruct(upper_pts[i])[0] > gh.Deconstruct(upper_pts[j])[0]:
                 temp_up = upper_pts[i]
                 upper_pts[i] = upper_pts[j]
                 upper_pts[j] = temp_up
    i=0
    j=0
    
    for i in range(len(lower_pts)):
         for j in range(len(lower_pts)):
             if gh.Deconstruct(lower_pts[i])[0] < gh.Deconstruct(lower_pts[j])[0]:
                 temp_down = lower_pts[i]
                 lower_pts[i] = lower_pts[j]
                 lower_pts[j] = temp_down
    i=0
    j=0
    
    for i in range(len(upper_pts)):
        sorted_pts.append(upper_pts[i])
    i=0
    
    for i in range(len(lower_pts)):
        sorted_pts.append(lower_pts[i])
    print sorted_pts
    print len(sorted_pts)
    return rs.coerce3dpointlist(sorted_pts)
    
output = pts_sorter(input)
# ---------- end point_sorter ----------
output = ClusterOutput(point_sorter.output)  # Sorted Points
