# Grasshopper definition Generator_04_18_with_context_effect.gh (Grasshopper 1.0.7)
# Copyright: 2019

# ---- group: AREA DISTRIBIUTION OF THE SITE
# 1- FORM GENERATOR
site = Curve(<curve referenced from the Rhino model>)
pop2d = Populate2D(Region=site, Count=Slider(250, range=250..500), Seed=1)
panel = Panel("""25
15
30""")
space_distrbutor = GhPythonScript(prg_prc=panel)  # -> out, Residential_area, Retail_area, Office_area; inputs prg_typs: list, prg_prc: list of Int32
# ---------- space_distrbutor: Python ----------
__author__ = "milad"
__version__ = "2019.03.18"

import rhinoscriptsyntax as rs

t=0
if (len(prg_typs) == len(prg_prc)):
    for i in range(len(prg_prc)):
        t = t+ prg_prc[i]
    if(t<=70):
        Residential_area = site_area*float(prg_prc[0]/100)
        Retail_area = site_area*float(prg_prc[1]/100)
        Office_area = site_area*float(prg_prc[2]/100)
# ---------- end space_distrbutor ----------

area = Area(Geometry=site)  # -> Area, Centroid
panel_2 = Panel(area.Area)

# ----
panel_3 = Panel([Slider(30, range=0..100), Slider(15, range=0..100), Slider(40, range=0..100), Slider(15, range=0..100)])
panel_4 = Panel([Slider(14, range=12..18), Slider(15, range=12..18), Slider(12, range=12..18), Slider(15, range=12..18)])
panel_5 = Panel("""office
public
residential
retail""")
the_context = Brep([<brep referenced from the Rhino model> x136])
rotation_angle = Slider(2.5, range=-5..5)
giraffe = GhPythonScript(
    on_off=Toggle(False),
    const_perc="40",
    site_prem=site,
    input_context=the_context,
    context_range=Slider(250, range=0..1000),
    input_pts=pop2d,
    num_corners="7",
    programs=panel_5,
    total_floor_num=Slider(60, range=0..100),
    seed=Slider(2, range=1..15),
    prg_percentage=panel_3,
    prg_heights=panel_4,
    force=Slider(20, range=0..100),
    rotation_angle=rotation_angle)  # -> out, site_area, site_center, immediate_context, floor_pts, ret, ofc, res, pub_a, pub_b; inputs input_context: list, input_pts: list, programs: list, total_floor_num: Int32, seed: Int32, prg_percentage: list of Int32, prg_heights: list
# ---------- giraffe: Python ----------
__author__ = "milad"
__version__ = "2019.04.05"

import rhinoscriptsyntax as rs
import ghpythonlib.components as gh

ret = []
ofc = []
res = []
pub_a = []
pub_b = []
floor_retail_outlines = []
floor_residential_outlines = []
floor_public_outlines = []
floor_publicA_outlines = []
floor_publicB_outlines = []
floor_office_outlines = []
core_centers = []
floor_pts = []
index = []

#Site Information
site_area = rs.CurveArea(site_prem)[0]
site_center = rs.CurveAreaCentroid(site_prem)[0]


#Context : Get the information from the context
def closestBreps(breps,crv):
    ref = context_range
    i=0
    brep_centers = []
    sorted_breps = []
    closest_breps =[]
    for i in range(len(breps)):
        brep_centers.append(gh.Volume(rs.coercebrep(breps[i]))[1])
    i=0
    for i in range(len(breps)):
        distance = rs.Distance(gh.Area(rs.coercebrep(breps[i]))[1],rs.CurveAreaCentroid(crv)[0])
        if (distance <= ref):
            index = i
            sorted_breps.append(breps[i])
    i=0
    for i in range(len(sorted_breps)):
        closest_breps.append(rs.coercebrep(sorted_breps[len(sorted_breps)-1-i]))
    return closest_breps

immediate_context = closestBreps(input_context,site_prem)

def pts_sorter(pts_in):

    R_sort = []
    L_sort = []
    upper_pts = []
    lower_pts = []
    sorted_pts = []
    pts_in = rs.coerce3dpointlist(pts_in)
    i=0
    j=0
    for i in range(len(pts_in)):
        for j in range(len(pts_in)):
            if gh.Deconstruct(pts_in[i])[0] > gh.Deconstruct(pts_in[j])[0]:
                temp_L = pts_in[i]
                pts_in[i] = pts_in[j]
                pts_in[j] = temp_L
    L_sort = rs.coerce3dpointlist(pts_in)
    i = 0
    j=0
    
    for i in range(len(pts_in)):
        for j in range(len(pts_in)):
            if gh.Deconstruct(pts_in[i])[0] < gh.Deconstruct(pts_in[j])[0]:
                temp_R = pts_in[i]
                pts_in[i] = pts_in[j]
                pts_in[j] = temp_R
    R_sort =rs.coerce3dpointlist(pts_in)
    
    slope = (gh.Deconstruct(L_sort[0])[1]-gh.Deconstruct(R_sort[0])[1])/(gh.Deconstruct(L_sort[1])[0]-gh.Deconstruct(R_sort[0])[0])
    i=0
    j=0
    
    for i in range(len(pts_in)):
        y = slope * (gh.Deconstruct(pts_in[i])[0]-gh.Deconstruct(pts_in[0])[0])+gh.Deconstruct(pts_in[0])[1]
        if gh.Deconstruct(pts_in[i])[1] > y:
            upper_pts.append(pts_in[i])
        else:
            lower_pts.append(pts_in[i])
            
    for i in range(len(upper_pts)):
         for j in range(len(upper_pts)):
             if gh.Deconstruct(upper_pts[i])[0] > gh.Deconstruct(upper_pts[j])[0]:
                 temp_up = upper_pts[i]
                 upper_pts[i] = upper_pts[j]
                 upper_pts[j] = temp_up
    i=0
    j=0
    
    for i in range(len(lower_pts)):
         for j in range(len(lower_pts)):
             if gh.Deconstruct(lower_pts[i])[0] < gh.Deconstruct(lower_pts[j])[0]:
                 temp_down = lower_pts[i]
                 lower_pts[i] = lower_pts[j]
                 lower_pts[j] = temp_down
    i=0
    j=0
    
    for i in range(len(upper_pts)):
        sorted_pts.append(upper_pts[i])
    i=0
    
    for i in range(len(lower_pts)):
        sorted_pts.append(lower_pts[i])
        
    return rs.coerce3dpointlist(sorted_pts)



#Tower: Random Floor Generator

def rndm(num_rndms,seed_num):
    seeds = []
    seeds.extend(gh.Random(len(input_pts),num_rndms,seed_num))
    i=0
    for i in range(len(seeds)):
        seeds[i] = int(seeds[i])
    return seeds

# Context Impact
def punch(punch_curve,frc):
    in_curve_pts = []
    context_centers = []
    context = []
    i=0
    j=0
    _distance = 0
    in_curve_pts.extend(rs.AddPoints(rs.CurvePoints(punch_curve)))

    context.extend(closestBreps(input_context,punch_curve))
    i=0
    for i in range(len(context)):
        context_centers.append(gh.Volume(context[i])[1])
    i=0
    for i in range(len(context_centers)):
        closest_id = rs.PointArrayClosestPoint(in_curve_pts,context_centers[i])
        closest_pt = in_curve_pts[closest_id]
        _distance = rs.Distance(context_centers[i],closest_pt)
        vect = rs.VectorCreate(context_centers[i],closest_pt)
        vect1 =rs.CreateVector(vect[0],vect[1],0)
        in_curve_pts[closest_id] = rs.MoveObject(closest_pt,(frc/100)*_distance/1000*vect1)
    output_curve = gh.PolyLine(pts_sorter(in_curve_pts),True)
    return output_curve

# Rotation

def floor_rotate (r_crvs,base_angle):
    angle = 0
    angle1 = 0
    for i in range(len(r_crvs)):
        if i%2 == 0:
            angle = angle+base_angle
        else:
            angle1 = angle1-base_angle
        r_crvs[i] = rs.RotateObject(r_crvs[i],rs.CurveAreaCentroid(r_crvs[i])[0],angle,rs.CreateVector(0,0,1),False)
    return r_crvs
## TOWER STATICS:

#Floor Generator

# Distributing programs (%40 Residential %30 Office %15 Public/Rec %15 Retail)
i=0
j=0
for i in range(len(programs)):
    n_ret = int(prg_percentage[3]/100*total_floor_num)
    h_ret = float(prg_heights[3])
    n_ofc = int(prg_percentage[0]/100*total_floor_num)
    h_ofc = float(prg_heights[0])
    n_pub = int(prg_percentage[1]/100*total_floor_num)
    h_pub = float(prg_heights[1])
    n_res = int(prg_percentage[2]/100*total_floor_num)
    h_res = float(prg_heights[2])
    if programs[i] == 'retail':
        index.extend(rndm(num_corners,seed+i))
        for j in range(len(index)):
            floor_pts.append(input_pts[index[j]])
        floor_pts = pts_sorter(rs.coerceguidlist(floor_pts))
        floor_pts.append(floor_pts[0])
        floor_retail_outlines.append((rs.AddPolyline(floor_pts)))
        i=0
        for i in range(1,n_ret+1):
            floor_retail_outlines.append(rs.CopyObject(floor_retail_outlines[0],rs.CreateVector(0,0,i*h_ret)))
        i=0
        j=0
    elif programs[i] == 'office':
        index.extend(rndm(num_corners,seed+i))
        for j in range(len(index)):
            floor_pts.append(input_pts[index[j]])
        floor_pts = pts_sorter(floor_pts)
        floor_pts.append(floor_pts[0])
        floor_office_outlines.append((rs.AddPolyline(floor_pts)))
        i=0
        for i in range(1,n_ofc+1):
            floor_office_outlines.append(rs.CopyObject(floor_office_outlines[0],rs.CreateVector(0,0,i*h_ofc)))
        i=0
        j=0
    elif programs[i] == 'residential':
        index.extend(rndm(num_corners,seed+i))
        for j in range(len(index)):
            floor_pts.append(input_pts[index[j]])
        floor_pts = pts_sorter(rs.coerceguidlist(floor_pts))
        floor_pts.append(floor_pts[0])
        floor_residential_outlines.append((rs.AddPolyline(floor_pts)))
        i=0
        j=0
        for i in range(1,n_res+1):
            floor_residential_outlines.append(rs.CopyObject(floor_residential_outlines[0],rs.CreateVector(0,0,i*h_res)))
        i=0
        j=0
    elif programs[i] == 'public':
        index.extend(rndm(num_corners,seed+i))
        for j in range(len(index)):
            floor_pts.append(input_pts[index[j]])
        floor_pts = pts_sorter(rs.coerceguidlist(floor_pts))
        floor_pts.append(floor_pts[0])
        floor_public_outlines.append((rs.AddPolyline(floor_pts)))
        i=0
        j=0
        for i in range(1,n_pub):
            floor_public_outlines.append(rs.CopyObject(floor_public_outlines[0],rs.CreateVector(0,0,i*h_pub)))
    else:
        print("Not a valid program type!")




index.extend(rndm(7,3))



for i in range(len(floor_retail_outlines)):
    floor_retail_outlines[i] = punch(floor_retail_outlines[i],float(force))
    floor_retail_outlines[i] = rs.AddPolyline(rs.CurvePoints(gh.FilletDistance(rs.coercecurve(floor_retail_outlines[i]),15)))
    rs.CurveDirectionsMatch(floor_retail_outlines[0],floor_office_outlines[i])


for i in range(len(floor_office_outlines)):
    floor_office_outlines[i] = punch(floor_office_outlines[i],float(force))
    floor_office_outlines[i]= rs.AddPolyline(rs.CurvePoints(gh.FilletDistance(rs.coercecurve(floor_office_outlines[i]),15)))
    rs.CurveDirectionsMatch(floor_office_outlines[0],floor_office_outlines[i])
rs.MoveObjects(floor_office_outlines,rs.CreateVector(0,0,n_ret*h_ret+(int(n_pub/2)-1)*h_pub))



for i in range(len(floor_residential_outlines)):
    floor_residential_outlines[i] = punch(floor_residential_outlines[i],float(force))
    floor_residential_outlines[i]= rs.AddPolyline(rs.CurvePoints(gh.FilletDistance(rs.coercecurve(floor_residential_outlines[i]),15)))
    rs.CurveDirectionsMatch(floor_residential_outlines[0],floor_residential_outlines[i])
rs.MoveObjects(floor_residential_outlines,rs.CreateVector(0,0,int(n_ret*h_ret+(n_ofc-1)*h_ofc+(n_pub-1)*h_pub)-1))


for i in range(int(n_pub/2)):
    floor_public_outlines[i] = punch(floor_public_outlines[i],float(force))
    rs.CurveDirectionsMatch(floor_public_outlines[0],floor_public_outlines[i])
    floor_publicA_outlines.append(rs.AddPolyline(rs.CurvePoints(gh.FilletDistance(rs.coercecurve(floor_public_outlines[i]),15))))
rs.MoveObjects(floor_publicA_outlines,rs.CreateVector(0,0,n_ret*h_ret))

for i in range(int(n_pub/2),len(floor_public_outlines)):
    floor_public_outlines[i] = punch(floor_public_outlines[i],float(force))
    rs.CurveDirectionsMatch(floor_public_outlines[0],floor_public_outlines[i])
    floor_publicB_outlines.append(rs.AddPolyline(rs.CurvePoints(gh.FilletDistance(rs.coercecurve(floor_public_outlines[i]),15))))

rs.MoveObjects(floor_publicB_outlines,rs.CreateVector(0,0,n_ofc*h_ofc+(n_ret-1)*h_ret))


# Check the centers/ Tower Stability

ret_c = rs.AddPoint(rs.CurveAreaCentroid(floor_retail_outlines[0])[0][0],rs.CurveAreaCentroid(floor_retail_outlines[0])[0][1],0)
ofc_c = rs.AddPoint(rs.CurveAreaCentroid(floor_office_outlines[0])[0][0],rs.CurveAreaCentroid(floor_office_outlines[0])[0][1],0)
res_c = rs.AddPoint(rs.CurveAreaCentroid(floor_residential_outlines[0])[0][0],rs.CurveAreaCentroid(floor_residential_outlines[0])[0][1],0)
pubA_c = rs.AddPoint(rs.CurveAreaCentroid(floor_publicA_outlines[0])[0][0],rs.CurveAreaCentroid(floor_publicA_outlines[0])[0][1],0)
pubB_c = rs.AddPoint(rs.CurveAreaCentroid(floor_publicB_outlines[0])[0][0],rs.CurveAreaCentroid(floor_publicB_outlines[0])[0][1],0)

if rs.Distance(ret_c,ofc_c) > 15:
    rs.MoveObjects(floor_office_outline,rs.VectorCreate(ret_c,ofc_c))
if rs.Distance(ret_c,res_c) > 15:
    rs.MoveObjects(floor_residential_outline,rs.VectorCreate(ret_c,res_c))
if rs.Distance(ret_c,pubA_c) > 15:
    rs.MoveObjects(floor_publicA_outline,rs.VectorCreate(ret_c,pubA_c))
if rs.Distance(ret_c,pubB_c) > 15:
    rs.MoveObjects(floor_publicB_outline,rs.VectorCreate(ret_c,pubB_c))


floor_retail_outlines = floor_rotate(floor_retail_outlines,rotation_angle)
floor_office_outlines = floor_rotate(floor_office_outlines,rotation_angle)
floor_residential_outlines = floor_rotate(floor_residential_outlines,rotation_angle)
floor_publicA_outlines = floor_rotate(floor_publicA_outlines,rotation_angle)
floor_publicB_outlines = floor_rotate(floor_publicB_outlines,rotation_angle)


ret.extend(floor_retail_outlines)
ofc.extend(floor_office_outlines)
res.extend(floor_residential_outlines)
pub_a.extend(floor_publicA_outlines)
pub_b.extend(floor_publicB_outlines)

#Tower: Information

print("Construction area : ")
print("Total Sqft : ")
print '\t'
print len(floor_retail_outlines)
# ---------- end giraffe ----------
brep = Brep(giraffe.immediate_context)
panel_6 = Panel(giraffe.out)

# ---- group: Structure Diagrid
number_slider = Slider(16, range=0..100)  # disabled
number_slider_2 = Slider(60, range=0..100)  # disabled
number_slider_3 = Slider(72, range=0..100)  # disabled
diagrid = GhPythonScript(input_crvs=giraffe.res, number=number_slider)  # -> out, output_crvs; inputs input_crvs: list; disabled
# ---------- diagrid: Python ----------
__author__ = "milad"
__version__ = "2019.04.15"

import rhinoscriptsyntax as rs
import ghpythonlib.components as gh

crv_pts = []
lines = []
for i in range(len(input_crvs)-1):
    crv_pts.append(rs.DivideCurve(input_crvs[i],number,True,True))
    crv_pts.append(rs.DivideCurve(input_crvs[i+1],number,True,True))
i=0
for i in range(len(crv_pts)-1):
    if i%2 ==0:
        for j in range(len(crv_pts[i])-1):
            lines.append(rs.AddLine(crv_pts[i][j],crv_pts[i+1][j-1]))
            lines.append(rs.AddLine(crv_pts[i][j],crv_pts[i+1][j+1]))
#    else:
#        for j in range(len(crv_pts[i+1])-1):
#            lines.append(rs.AddLine(crv_pts[i][j],crv_pts[i+1][j]))

output_crvs = lines
# ---------- end diagrid ----------
diagrid_2 = GhPythonScript(input_crvs=giraffe.ofc, number=number_slider_2)  # -> out, output_crvs; inputs input_crvs: list; disabled; same code as diagrid
diagrid_3 = GhPythonScript(input_crvs=giraffe.ret, number=number_slider_3)  # -> out, output_crvs; inputs input_crvs: list; disabled; same code as diagrid

# ----
crv = Curve(giraffe.pub_b)
crv_2 = Curve(giraffe.res)
crv_3 = Curve(giraffe.ofc)
crv_4 = Curve(giraffe.ret)
crv_5 = Curve(giraffe.pub_a)
loft = Loft(Curves=crv_2, Options={Adjust=True, Closed=False, LoftEnds=0, LoftSimp=0, LoftType=3, Rebuild=10, Refit=0.01})
loft_2 = Loft(Curves=crv, Options={Adjust=True, Closed=False, LoftEnds=0, LoftSimp=0, LoftType=3, Rebuild=10, Refit=0.01})
loft_3 = Loft(Curves=crv_3, Options={Adjust=True, Closed=False, LoftEnds=0, LoftSimp=0, LoftType=3, Rebuild=10, Refit=0.01})
loft_4 = Loft(Curves=crv_5, Options={Adjust=True, Closed=False, LoftEnds=0, LoftSimp=0, LoftType=3, Rebuild=10, Refit=0.01})
loft_5 = Loft(Curves=crv_4, Options={Adjust=True, Closed=False, LoftEnds=0, LoftSimp=0, LoftType=3, Rebuild=10, Refit=0.01})
cap = CapHoles(Brep=loft)
cap_2 = CapHoles(Brep=loft_2)
cap_3 = CapHoles(Brep=loft_3)
cap_4 = CapHoles(Brep=loft_4)
cap_5 = CapHoles(Brep=loft_5)

join = BrepJoin(Breps=flatten([cap, cap_2, cap_3, cap_4, cap_5]))  # -> Breps, Closed

baby_giraffe = GhPythonScript(ret=giraffe.ret, ofc=giraffe.ofc, res=giraffe.res)  # -> out, ret_slab, ofc_slab, res_slab, ret_core, ofc_core, res_core; inputs ret: list, ofc: list, res: list
# ---------- baby_giraffe: Python ----------
__author__ = "milad"
__version__ = "2019.04.16"

import rhinoscriptsyntax as rs
import ghpythonlib.components as gh

ret_slab = []
ofc_slab = []
res_slab = []

#Slab Generator:
def slab_gen(slab_crv,thickness):
    slab = gh.CapHoles(gh.Extrude(rs.coercecurve(slab_crv),rs.CreateVector(0,0,thickness)))
    return slab

for i in range(len(ret)):
    ret_slab.append(slab_gen(ret[i],-1))


for i in range(len(ofc)):
    ofc_slab.append(slab_gen(ofc[i],-1))


for i in range(len(res)):
    res_slab.append(slab_gen(res[i],-1))
# ---------- end baby_giraffe ----------
brep_2 = Brep([baby_giraffe.ret_slab, baby_giraffe.ofc_slab, baby_giraffe.res_slab])  # disabled

# ---- group: Structural Element Generator
crv_6 = Curve(diagrid_3.output_crvs)  # disabled

graft = GraftTree(Tree=crv_6, IncludeEmptyLists=True, IncludeNullItems=True)  # disabled
end = EndPoints(Curve=graft)  # -> Start, End; disabled
eval = EvaluateLength(Curve=graft, Length=1, Normalized=True)  # -> Point, Tangent, Parameter; disabled
vec2pt = Vector2Pt(PointA=end.Start, PointB=eval.Point, Unitize=False)  # -> Vector, Length; disabled
number_slider_4 = Slider(0.25, range=0..5.5)  # disabled
pl = PlaneNormal(Origin=end.Start, ZAxis=vec2pt.Vector)  # disabled
rectangle = Rectangle(Plane=pl, XSize=number_slider_4, YSize=number_slider_4, Radius=0)  # -> Rectangle, Length; disabled
swp1 = Sweep1(Rail=graft, Sections=rectangle.Rectangle, Miter=1)  # -> flatten(Brep); disabled

cap_6 = CapHoles(Brep=swp1)  # -> flatten(Brep); disabled
preview = CustomPreview(
    Geometry=cap_6,
    Material={diffuse=RGB(228, 0, 22), emission=RGB(0, 0, 0), shine=0, specular=RGB(255, 255, 255), transparency=0})  # disabled
