# Grasshopper definition Giraffe_2.0.gh (Grasshopper 1.0.7)
# Copyright: 2019
# plug-ins: Human UI, Human, Opossum

site = Curve(<curve referenced from the Rhino model>)  # disabled
number_slider = Slider(600, range=0..1000)  # disabled

# ---- group: AREA DISTRIBIUTION OF THE SITE
# 1- FORM GENERATOR
site_2 = Curve(<curve referenced from the Rhino model>)
pop2d = Populate2D(Region=site_2, Count=Slider(250, range=250..500), Seed=1)
panel = Panel("""25
15
30""")
space_distrbutor = GhPythonScript(prg_prc=panel)  # -> out, Residential_area, Retail_area, Office_area; inputs prg_typs: list, prg_prc: list of Int32
# ---------- space_distrbutor: Python ----------
__author__ = "milad"
__version__ = "2019.03.18"

import rhinoscriptsyntax as rs

t=0
if (len(prg_typs) == len(prg_prc)):
    for i in range(len(prg_prc)):
        t = t+ prg_prc[i]
    if(t<=70):
        Residential_area = site_area*float(prg_prc[0]/100)
        Retail_area = site_area*float(prg_prc[1]/100)
        Office_area = site_area*float(prg_prc[2]/100)
# ---------- end space_distrbutor ----------

# ----
context = Brep([<brep referenced from the Rhino model> x136])  # disabled
site_area = Area(Geometry=site)  # -> Area, Centroid; disabled
panel_2 = Panel(site_area.Area)  # disabled
number_slider_2 = Slider(60, range=0..100)

# ---- group: AREA DISTRIBIUTION OF THE SITE
area = Area(Geometry=site_2)  # -> Area, Centroid
panel_3 = Panel(area.Area)

# ----
panel_4 = Panel("100")  # disabled
panel_5 = Panel([Slider(14, range=12..18), Slider(15, range=12..18), Slider(12, range=12..18), Slider(15, range=12..18)])
number_slider_3 = Slider(1, range=-10..10)
rotation_angle = Slider(1.5, range=-3..3)
panel_6 = Panel([Slider(30, range=0..100), Slider(15, range=0..100), Slider(40, range=0..100), Slider(15, range=0..100)])
number_slider_4 = Slider(450, range=0..1000)
panel_7 = Panel("""office
public
residential
retail""")
number_slider_5 = Slider(5, range=1..15)
toggle = BooleanToggle(True)
the_context = Brep([<brep referenced from the Rhino model> x133])
integer_division = IntegerDivision(A=panel_2, B=panel_4)  # disabled
cap = CapHoles(Brep=the_context)
context_finder = GhPythonScript(input_context=context, context_range=number_slider, site_prem=site)  # -> immediate_context, out; inputs input_context: list; disabled
# ---------- context_finder: Python ----------
__author__ = "milad"
__version__ = "2019.11.29"
        
import rhinoscriptsyntax as rs
import ghpythonlib.components as gh
import scriptcontext as sc
        
sc.doc = ghdoc
        
    #Context : Get the information from the context
def closestBreps(breps,crv):
    ref = context_range
    i=0
    brep_centers = []
    sorted_breps = []
    closest_breps =[]
    for i in range(len(breps)):
        brep_centers.append(gh.Volume(rs.coercebrep(breps[i]))[1])
    i=0
    for i in range(len(breps)):
        distance = rs.Distance(gh.Area(rs.coercebrep(breps[i]))[1],rs.CurveAreaCentroid(crv)[0])
        print distance
        if (distance <= ref):
            index = i
            sorted_breps.append(breps[i])
    i=0
    for i in range(len(sorted_breps)):
        closest_breps.append(rs.coercebrep(sorted_breps[len(sorted_breps)-1-i]))
    return closest_breps
        
immediate_context = closestBreps(input_context,site_prem)
# ---------- end context_finder ----------
panel_8 = Panel("""residential
office
commercial""")  # disabled
panel_9 = Panel("""30
20
15""")  # disabled
pop2d_2 = Populate2D(Region=site, Count=integer_division, Seed=1)  # disabled
panel_10 = Panel("50")  # disabled
panel_11 = Panel("30")  # disabled
giraffe = GhPythonScript(
    on_off=toggle,
    const_perc="15",
    site_prem=site_2,
    input_context=cap,
    context_range=number_slider_4,
    input_pts=pop2d,
    num_corners=Slider(12, range=3..15),
    programs=panel_7,
    total_floor_num=number_slider_2,
    prg_percentage=panel_6,
    prg_heights=panel_5,
    force=number_slider_3,
    rotation_angle=rotation_angle)  # -> out, site_area, site_center, immediate_context, floor_pts, ret, ofc, res, pub_a, pub_b; inputs const_perc: Int32, input_context: list, input_pts: list of Point3d, programs: list, total_floor_num: Int32, prg_percentage: list of Int32, prg_heights: list of Int32
# ---------- giraffe: Python ----------
__author__ = "milad"
__version__ = "2019.04.05"

import rhinoscriptsyntax as rs
import ghpythonlib.components as gh
import scriptcontext as sc
import random

###################
sc.doc = ghdoc

####################
#_______Variables__________#
ret = []
ofc = []
res = []
pub_a = []
pub_b = []
floor_retail_outlines = []
floor_residential_outlines = []
floor_public_outlines = []
floor_publicA_outlines = []
floor_publicB_outlines = []
floor_office_outlines = []
core_centers = []
floor_pts = []
index = []

if on_off == True:
    print("Giraffe is awake!\nSystem is running.....\n")

    #Site Information
    site_area = rs.CurveArea(site_prem)[0]
    site_center = rs.CurveAreaCentroid(site_prem)[0]
    
    
    #Context : Get the information from the context
    def closestBreps(breps,crv):
        ref = context_range
        brep_centers = []
        sorted_breps = []
        for i in range(len(breps)):
            brep_centers.append(gh.Volume(rs.coercebrep(breps[i]))[1])
        for i in range(len(breps)):
            distance = rs.Distance(gh.Area(rs.coercebrep(breps[i]))[1],site_center)
            if (distance <= ref):
                sorted_breps.append(breps[i])
        sorted_breps.sort()
        return sorted_breps
    
    immediate_context = closestBreps(input_context,site_prem)
    
    def pts_sorter(pts_in):
    
        R_sort = []
        L_sort = []
        upper_pts = []
        lower_pts = []
        sorted_pts = []
        pts_in = rs.coerce3dpointlist(pts_in)
        for i in range(len(pts_in)):
            for j in range(len(pts_in)):
                if gh.Deconstruct(pts_in[i])[0] > gh.Deconstruct(pts_in[j])[0]:
                    temp_L = pts_in[i]
                    pts_in[i] = pts_in[j]
                    pts_in[j] = temp_L
        L_sort = rs.coerce3dpointlist(pts_in)
        
        for i in range(len(pts_in)):
            for j in range(len(pts_in)):
                if gh.Deconstruct(pts_in[i])[0] < gh.Deconstruct(pts_in[j])[0]:
                    temp_R = pts_in[i]
                    pts_in[i] = pts_in[j]
                    pts_in[j] = temp_R
        R_sort =rs.coerce3dpointlist(pts_in)
        if ((gh.Deconstruct(L_sort[1])[0]-gh.Deconstruct(R_sort[0])[0])!=0):
            slope = (gh.Deconstruct(L_sort[0])[1]-gh.Deconstruct(R_sort[0])[1])/(gh.Deconstruct(L_sort[1])[0]-gh.Deconstruct(R_sort[0])[0])
        else:
            slope = 1
        
        for i in range(len(pts_in)):
            y = slope * (gh.Deconstruct(pts_in[i])[0]-gh.Deconstruct(pts_in[0])[0])+gh.Deconstruct(pts_in[0])[1]
            if gh.Deconstruct(pts_in[i])[1] > y:
                upper_pts.append(pts_in[i])
            else:
                lower_pts.append(pts_in[i])
                
        for i in range(len(upper_pts)):
             for j in range(len(upper_pts)):
                 if gh.Deconstruct(upper_pts[i])[0] > gh.Deconstruct(upper_pts[j])[0]:
                     temp_up = upper_pts[i]
                     upper_pts[i] = upper_pts[j]
                     upper_pts[j] = temp_up
        
        for i in range(len(lower_pts)):
             for j in range(len(lower_pts)):
                 if gh.Deconstruct(lower_pts[i])[0] < gh.Deconstruct(lower_pts[j])[0]:
                     temp_down = lower_pts[i]
                     lower_pts[i] = lower_pts[j]
                     lower_pts[j] = temp_down
        
        for i in range(len(upper_pts)):
            sorted_pts.append(upper_pts[i])
        
        for i in range(len(lower_pts)):
            sorted_pts.append(lower_pts[i])
            
        return rs.coerce3dpointlist(sorted_pts)

    #Tower: Random Floor Generator
    
    def rndm_pts(num_rndms):
        index = []
        selected_pts = []
        temp_index = 0
        while len(index) <num_rndms:
            for i in range(int(num_rndms)):
                x = int(random.uniform(0,len(input_pts)))
                if x != temp_index and len(index)<=1:
                    index.append(random.uniform(0,len(input_pts)))
                    temp_index = x
                elif x != temp_index and len(index)>1:
                    for data in index:
                        if 60 <gh.Distance(rs.coerce3dpoint(input_pts[x]),rs.coerce3dpoint(input_pts[int(data)])) < 200:
                            index.append(x)
                            temp_index = x
                else:
                    break
        for item in index:
            selected_pts.append(input_pts[int(item)])
        return gh.CleanTree(True,True,True,selected_pts)
    # Context Impact
    def punch(punch_curve,frc):
        in_curve_pts = []
        context_centers = []
        context = []
        _distance = 0
        in_curve_pts.extend(rs.AddPoints(rs.CurvePoints(punch_curve)))
        context.extend(closestBreps(input_context,punch_curve))
        for i in range(len(context)):
            context_centers.append(gh.Volume(context[i])[1])
        for i in range(len(context_centers)):
            closest_id = rs.PointArrayClosestPoint(in_curve_pts,context_centers[i])
            closest_pt = in_curve_pts[closest_id]
            _distance = rs.Distance(context_centers[i],closest_pt)
            vect = rs.VectorCreate(context_centers[i],closest_pt)
            vect1 =rs.CreateVector(vect[0],vect[1],0)
            in_curve_pts[closest_id] = rs.MoveObject(closest_pt,(frc/100)*_distance/1000*vect1)
        output_curve = gh.PolyLine(gh.CullDuplicates(pts_sorter(in_curve_pts),0.1)[0],True)
        return output_curve
    # Rotation
    
    def floor_rotate(r_crvs,base_angle):
        angle = 0
        angle1 = 0
        for i in range(len(r_crvs)):
            if i%2 == 0:
                angle = angle+base_angle
            else:
                angle1 = angle1-base_angle
            r_crvs[i] = rs.RotateObject(r_crvs[i],rs.CurveAreaCentroid(r_crvs[i])[0],angle,rs.CreateVector(0,0,1),False)
        return r_crvs
    ## TOWER STATICS:
    
    #Floor Generator
    def floor_gen(prg_type):
        check = True
        d_cgeck = False
        index=[]
        floor_pts=[]
        while check:
            del index[:]
            del floor_pts[:]
            floor_pts = rndm_pts(num_corners)
            floor_pts = pts_sorter(floor_pts)
            temp_floor = gh.PolyLine(floor_pts,True)
            if 12000 <=rs.CurveArea(temp_floor)[0] <= (site_area*(const_perc/100)):
                check = False
                break
        if prg_type == 'retail':
            for i in range(1,n_ret):
                floor_retail_outlines.append(rs.CopyObject(temp_floor,rs.CreateVector(0,0,i*h_ret)))
        elif prg_type == 'office':
            for i in range(1,n_ofc):
                floor_office_outlines.append(rs.CopyObject(temp_floor,rs.CreateVector(0,0,i*h_ofc)))
        elif prg_type == 'residential':
            for i in range(1,n_res):
                floor_residential_outlines.append(rs.CopyObject(temp_floor,rs.CreateVector(0,0,i*h_res)))
        elif prg_type == 'public':
            for i in range(1,n_pub):
                floor_public_outlines.append(rs.CopyObject(temp_floor,rs.CreateVector(0,0,i*h_pub)))
        else:
            print("Not a valid program type!")
                
    
    
    # Distributing programs (%40 Residential %30 Office %15 Public/Rec %15 Retail)
    n_ret = int(prg_percentage[3]/100*total_floor_num)
    n_ofc = int(prg_percentage[0]/100*total_floor_num)
    n_pub = int(prg_percentage[1]/100*total_floor_num)
    n_res = int(prg_percentage[2]/100*total_floor_num)
    h_ret = float(prg_heights[3])
    h_pub = float(prg_heights[1])
    h_ofc = float(prg_heights[0])
    h_res = float(prg_heights[2])
    
    
    floor_gen('residential')
    floor_gen('office')
    floor_gen('retail')
    floor_gen('public')

    
    for i in range(len(floor_retail_outlines)):
        floor_retail_outlines[i] = punch(floor_retail_outlines[i],float(force))
        floor_retail_outlines[i] = gh.PolyLine(pts_sorter(gh.CleanTree(True,True,True,rs.CurvePoints(gh.FilletDistance(rs.coercecurve(floor_retail_outlines[i]),30)))),True)
        rs.CurveDirectionsMatch(floor_retail_outlines[0],floor_office_outlines[i])

    for i in range(len(floor_office_outlines)):
        floor_office_outlines[i] = punch(floor_office_outlines[i],float(force))
        floor_office_outlines[i]= gh.PolyLine(pts_sorter(gh.CleanTree(True,True,True,rs.CurvePoints(gh.FilletDistance(rs.coercecurve(floor_office_outlines[i]),30)))),True)
        rs.CurveDirectionsMatch(floor_office_outlines[0],floor_office_outlines[i])
    
    
    for i in range(len(floor_residential_outlines)):
        floor_residential_outlines[i] = punch(floor_residential_outlines[i],float(force))
        floor_residential_outlines[i]= gh.PolyLine(pts_sorter(gh.CleanTree(True,True,True,rs.CurvePoints(gh.FilletDistance(rs.coercecurve(floor_residential_outlines[i]),30)))),True)
        rs.CurveDirectionsMatch(floor_residential_outlines[0],floor_residential_outlines[i])
    
    
    
    for i in range(int(n_pub/2)):
        floor_public_outlines[i] = punch(floor_public_outlines[i],float(force))
        rs.CurveDirectionsMatch(floor_public_outlines[0],floor_public_outlines[i])
        floor_publicA_outlines.append(gh.PolyLine(pts_sorter(gh.CleanTree(True,True,True,rs.CurvePoints(gh.FilletDistance(rs.coercecurve(floor_public_outlines[i]),30)))),True))
    
    
    for i in range(int(n_pub/2),len(floor_public_outlines)):
        floor_public_outlines[i] = punch(floor_public_outlines[i],float(force))
        rs.CurveDirectionsMatch(floor_public_outlines[0],floor_public_outlines[i])
        floor_publicB_outlines.append(gh.PolyLine(pts_sorter(gh.CleanTree(True,True,True,rs.CurvePoints(gh.FilletDistance(rs.coercecurve(floor_public_outlines[i]),30)))),True))
    # Retail
    h1 = int((len(floor_retail_outlines)-1)*h_ret)
    # Retail+PubA
    h2 = int(h1 + (len(floor_publicA_outlines)-1)*h_pub)
    # Retail+PubA+Office
    h3 = int(h2 + (len(floor_office_outlines)-1)*h_ofc)
    h3_b = h3- (len(floor_publicA_outlines))*h_pub
    # Retail+PubA+office+PubB
    h4 = int(h3 + (len(floor_publicB_outlines)-1)*h_pub)
    
    
    rs.MoveObjects(floor_publicA_outlines,rs.CreateVector(0,0,h1))
    rs.MoveObjects(floor_office_outlines,rs.CreateVector(0,0,h2))
    rs.MoveObjects(floor_publicB_outlines,rs.CreateVector(0,0,h3_b))
    rs.MoveObjects(floor_residential_outlines,rs.CreateVector(0,0,h4))
    
    
    
    # Check the centers/ Tower Stability
    
    ret_c = rs.AddPoint(rs.CurveAreaCentroid(floor_retail_outlines[0])[0][0],rs.CurveAreaCentroid(floor_retail_outlines[0])[0][1],0)
    ofc_c = rs.AddPoint(rs.CurveAreaCentroid(floor_office_outlines[0])[0][0],rs.CurveAreaCentroid(floor_office_outlines[0])[0][1],0)
    res_c = rs.AddPoint(rs.CurveAreaCentroid(floor_residential_outlines[0])[0][0],rs.CurveAreaCentroid(floor_residential_outlines[0])[0][1],0)
    pubA_c = rs.AddPoint(rs.CurveAreaCentroid(floor_publicA_outlines[0])[0][0],rs.CurveAreaCentroid(floor_publicA_outlines[0])[0][1],0)
    pubB_c = rs.AddPoint(rs.CurveAreaCentroid(floor_publicB_outlines[0])[0][0],rs.CurveAreaCentroid(floor_publicB_outlines[0])[0][1],0)
    
    if rs.Distance(ret_c,ofc_c) > 5:
        rs.MoveObjects(floor_office_outlines,rs.VectorCreate(ret_c,ofc_c))
    if rs.Distance(ret_c,res_c) > 5:
        rs.MoveObjects(floor_residential_outlines,rs.VectorCreate(ret_c,res_c))
    if rs.Distance(ret_c,pubA_c) > 5:
        rs.MoveObjects(floor_publicA_outlines,rs.VectorCreate(ret_c,pubA_c))
    if rs.Distance(ret_c,pubB_c) > 5:
        rs.MoveObjects(floor_publicB_outlines,rs.VectorCreate(ret_c,pubB_c))
    
    
    floor_retail_outlines = floor_rotate(floor_retail_outlines,rotation_angle)
    floor_office_outlines = floor_rotate(floor_office_outlines,rotation_angle)
    floor_residential_outlines = floor_rotate(floor_residential_outlines,rotation_angle)
    floor_publicA_outlines = floor_rotate(floor_publicA_outlines,rotation_angle)
    floor_publicB_outlines = floor_rotate(floor_publicB_outlines,rotation_angle)
    
    
    ret.extend(gh.CleanTree(True,True,True,floor_retail_outlines))
    ofc.extend(gh.CleanTree(True,True,True,floor_office_outlines))
    res.extend(gh.CleanTree(True,True,True,floor_residential_outlines))
    pub_a.extend(gh.CleanTree(True,True,True,floor_publicA_outlines))
    pub_b.extend(gh.CleanTree(True,True,True,floor_publicB_outlines))
    
    #Tower: Information
    
    print("Construction area : " , float((const_perc*site_area)/100),'\n')
    print("Total Sqft : ")
else:
    print ("Shhhhhhh! Giraffe is sleeping!")
# ---------- end giraffe ----------
immediate_context = Brep(context_finder.immediate_context)  # disabled
footprint_gen = GhPythonScript(
    site=site,
    site_area=site_area.Area,
    in_points=pop2d_2,
    programs=panel_8,
    programs_perc=panel_9,
    total_floor_num=panel_10,
    built_area_perc=panel_11)  # -> out, footprints; inputs in_points: list, programs: list, programs_perc: list; disabled
# ---------- footprint_gen: Python ----------
__author__ = "milad"
__version__ = "2020.01.05"

import rhinoscriptsyntax as rs
import ghpythonlib.components as gh
import scriptcontext as sc
        
sc.doc = ghdoc

def pts_sorter(pts_in):

    R_sort = []
    L_sort = []
    upper_pts = []
    lower_pts = []
    sorted_pts = []
    
    for i in range(len(pts_in)):
        for j in range(len(pts_in)):
            if gh.Deconstruct(pts_in[i])[0] > gh.Deconstruct(pts_in[j])[0]:
                temp_L = pts_in[i]
                pts_in[i] = pts_in[j]
                pts_in[j] = temp_L
    L_sort = pts_in
    i = 0
    j=0
    
    for i in range(len(pts_in)):
        for j in range(len(pts_in)):
            if gh.Deconstruct(pts_in[i])[0] < gh.Deconstruct(pts_in[j])[0]:
                temp_R = pts_in[i]
                pts_in[i] = pts_in[j]
                pts_in[j] = temp_R
    R_sort = pts_in
    
    slope = (gh.Deconstruct(L_sort[0])[1]-gh.Deconstruct(R_sort[0])[1])/(gh.Deconstruct(L_sort[1])[0]-gh.Deconstruct(R_sort[0])[0])
    i=0
    j=0
    
    for i in range(len(pts_in)):
        y = slope*(gh.Deconstruct(pts_in[i])[0]-gh.Deconstruct(pts_in[0])[0])+gh.Deconstruct(pts_in[0])[1]
        if gh.Deconstruct(pts_in[i])[1] > y:
            upper_pts.append(pts_in[i])
        else:
            lower_pts.append(pts_in[i])
            
    for i in range(len(upper_pts)):
         for j in range(len(upper_pts)):
             if gh.Deconstruct(upper_pts[i])[0] > gh.Deconstruct(upper_pts[j])[0]:
                 temp_up = upper_pts[i]
                 upper_pts[i] = upper_pts[j]
                 upper_pts[j] = temp_up
    i=0
    j=0
    
    for i in range(len(lower_pts)):
         for j in range(len(lower_pts)):
             if gh.Deconstruct(lower_pts[i])[0] < gh.Deconstruct(lower_pts[j])[0]:
                 temp_down = lower_pts[i]
                 lower_pts[i] = lower_pts[j]
                 lower_pts[j] = temp_down
    i=0
    j=0
    
    for i in range(len(upper_pts)):
        sorted_pts.append(upper_pts[i])
    i=0
    
    for i in range(len(lower_pts)):
        sorted_pts.append(lower_pts[i])
    print sorted_pts
    print len(sorted_pts)
    return rs.coerce3dpointlist(sorted_pts)
def rnd(s,e):
    num = 0
    pool = range(s,e)
    r = 0
    c = 0
    while (r< s or r>e) and c <20:
        r = gh.Jitter(pool,0.8,1)[1][2]
        c += 1
    return r
def fp_gen(num_pts):
    raw_pts = []
    shuffled_pts =rs.coerce3dpointlist(gh.Jitter(in_points,0.9,1)[0])
    rnd_i = gh.Random(len(shuffled_pts)-1,num_pts,1)
    for item in rnd_i:
        item = int(item)
        print(item)
        raw_pts.append(rs.coerce3dpoint(in_points[item]))
    return pts_sorter(raw_pts)

footprints = []
sides = rnd(3,9)
footprints.append(gh.PolyLine(fp_gen(sides),True))
# ---------- end footprint_gen ----------
volume = Volume(Geometry=immediate_context)  # -> Volume, Centroid; disabled

# ---- group: Structure Diagrid
number_slider_6 = Slider(16, range=0..100)  # disabled
number_slider_7 = Slider(60, range=0..100)  # disabled
number_slider_8 = Slider(72, range=0..100)  # disabled
diagrid = GhPythonScript(input_crvs=giraffe.res, number=number_slider_6)  # -> out, output_crvs; inputs input_crvs: list; disabled
# ---------- diagrid: Python ----------
__author__ = "milad"
__version__ = "2019.04.15"

import rhinoscriptsyntax as rs
import ghpythonlib.components as gh

crv_pts = []
lines = []
for i in range(len(input_crvs)-1):
    crv_pts.append(rs.DivideCurve(input_crvs[i],number,True,True))
    crv_pts.append(rs.DivideCurve(input_crvs[i+1],number,True,True))
i=0
for i in range(len(crv_pts)-1):
    if i%2 ==0:
        for j in range(len(crv_pts[i])-1):
            lines.append(rs.AddLine(crv_pts[i][j],crv_pts[i+1][j-1]))
            lines.append(rs.AddLine(crv_pts[i][j],crv_pts[i+1][j+1]))
#    else:
#        for j in range(len(crv_pts[i+1])-1):
#            lines.append(rs.AddLine(crv_pts[i][j],crv_pts[i+1][j]))

output_crvs = lines
# ---------- end diagrid ----------
diagrid_2 = GhPythonScript(input_crvs=giraffe.ofc, number=number_slider_7)  # -> out, output_crvs; inputs input_crvs: list; disabled; same code as diagrid
diagrid_3 = GhPythonScript(input_crvs=giraffe.ret, number=number_slider_8)  # -> out, output_crvs; inputs input_crvs: list; disabled; same code as diagrid

# ----
panel_12 = Panel(giraffe.out)

crv = Curve(giraffe.res)
crv_2 = Curve(giraffe.ofc)
crv_3 = Curve(giraffe.pub_b)
crv_4 = Curve(giraffe.ret)
crv_5 = Curve(giraffe.pub_a)
loft = Loft(Curves=crv, Options={Adjust=True, Closed=False, LoftEnds=0, LoftSimp=0, LoftType=3, Rebuild=10, Refit=0.01})
loft_2 = Loft(Curves=crv_3, Options={Adjust=True, Closed=False, LoftEnds=0, LoftSimp=0, LoftType=3, Rebuild=10, Refit=0.01})
loft_3 = Loft(Curves=crv_2, Options={Adjust=True, Closed=False, LoftEnds=0, LoftSimp=0, LoftType=3, Rebuild=10, Refit=0.01})
loft_4 = Loft(Curves=crv_5, Options={Adjust=True, Closed=False, LoftEnds=0, LoftSimp=0, LoftType=3, Rebuild=10, Refit=0.01})
loft_5 = Loft(Curves=crv_4, Options={Adjust=True, Closed=False, LoftEnds=0, LoftSimp=0, LoftType=3, Rebuild=10, Refit=0.01})
cap_2 = CapHoles(Brep=loft_2)
cap_3 = CapHoles(Brep=loft)
cap_4 = CapHoles(Brep=loft_3)
cap_5 = CapHoles(Brep=loft_4)
cap_6 = CapHoles(Brep=loft_5)

giraffe_2 = GhPythonScript(
    on_off=toggle,
    const_perc="15",
    site_prem=site_2,
    input_context=the_context,
    context_range=number_slider_4,
    input_pts=pop2d,
    programs=panel_7,
    total_floor_num=number_slider_2,
    seed=number_slider_5,
    prg_percentage=panel_6,
    prg_heights=panel_5,
    force=number_slider_3,
    rotation_angle=rotation_angle)  # -> out, site_area, site_center, immediate_context, floor_pts, ret, ofc, res, pub_a, pub_b; inputs const_perc: Int32, input_context: list, input_pts: list of Point3d, programs: list, total_floor_num: Int32, seed: Int32, prg_percentage: list of Int32, prg_heights: list of Int32; disabled
# ---------- giraffe_2: Python ----------
__author__ = "milad"
__version__ = "2019.04.05"

import rhinoscriptsyntax as rs
import ghpythonlib.components as gh
import scriptcontext as sc
import random

###################
sc.doc = ghdoc

####################
#_______Variables__________#
ret = []
ofc = []
res = []
pub_a = []
pub_b = []
floor_retail_outlines = []
floor_residential_outlines = []
floor_public_outlines = []
floor_publicA_outlines = []
floor_publicB_outlines = []
floor_office_outlines = []
core_centers = []
floor_pts = []
index = []

if on_off == True:
    print("Giraffe is awake!\nSystem is running.....\n")

    #Site Information
    site_area = rs.CurveArea(site_prem)[0]
    site_center = rs.CurveAreaCentroid(site_prem)[0]
    
    
    #Context : Get the information from the context
    def closestBreps(breps,crv):
        ref = context_range
        brep_centers = []
        sorted_breps = []
        for i in range(len(breps)):
            brep_centers.append(gh.Volume(rs.coercebrep(breps[i]))[1])
        for i in range(len(breps)):
            distance = rs.Distance(gh.Area(rs.coercebrep(breps[i]))[1],site_center)
            if (distance <= ref):
                sorted_breps.append(breps[i])
        sorted_breps.sort()
        return sorted_breps
    
    immediate_context = closestBreps(input_context,site_prem)
    
    def pts_sorter(pts_in):
    
        R_sort = []
        L_sort = []
        upper_pts = []
        lower_pts = []
        sorted_pts = []
        pts_in = rs.coerce3dpointlist(pts_in)
        for i in range(len(pts_in)):
            for j in range(len(pts_in)):
                if gh.Deconstruct(pts_in[i])[0] > gh.Deconstruct(pts_in[j])[0]:
                    temp_L = pts_in[i]
                    pts_in[i] = pts_in[j]
                    pts_in[j] = temp_L
        L_sort = rs.coerce3dpointlist(pts_in)
        
        for i in range(len(pts_in)):
            for j in range(len(pts_in)):
                if gh.Deconstruct(pts_in[i])[0] < gh.Deconstruct(pts_in[j])[0]:
                    temp_R = pts_in[i]
                    pts_in[i] = pts_in[j]
                    pts_in[j] = temp_R
        R_sort =rs.coerce3dpointlist(pts_in)
        if ((gh.Deconstruct(L_sort[1])[0]-gh.Deconstruct(R_sort[0])[0])!=0):
            slope = (gh.Deconstruct(L_sort[0])[1]-gh.Deconstruct(R_sort[0])[1])/(gh.Deconstruct(L_sort[1])[0]-gh.Deconstruct(R_sort[0])[0])
        else:
            slope = 1
        
        for i in range(len(pts_in)):
            y = slope * (gh.Deconstruct(pts_in[i])[0]-gh.Deconstruct(pts_in[0])[0])+gh.Deconstruct(pts_in[0])[1]
            if gh.Deconstruct(pts_in[i])[1] > y:
                upper_pts.append(pts_in[i])
            else:
                lower_pts.append(pts_in[i])
                
        for i in range(len(upper_pts)):
             for j in range(len(upper_pts)):
                 if gh.Deconstruct(upper_pts[i])[0] > gh.Deconstruct(upper_pts[j])[0]:
                     temp_up = upper_pts[i]
                     upper_pts[i] = upper_pts[j]
                     upper_pts[j] = temp_up
        
        for i in range(len(lower_pts)):
             for j in range(len(lower_pts)):
                 if gh.Deconstruct(lower_pts[i])[0] < gh.Deconstruct(lower_pts[j])[0]:
                     temp_down = lower_pts[i]
                     lower_pts[i] = lower_pts[j]
                     lower_pts[j] = temp_down
        
        for i in range(len(upper_pts)):
            sorted_pts.append(upper_pts[i])
        
        for i in range(len(lower_pts)):
            sorted_pts.append(lower_pts[i])
            
        return rs.coerce3dpointlist(sorted_pts)

    #Tower: Random Floor Generator
    
    def rndm(num_rndms,seed_num):
        seeds = []
        seeds.extend(gh.Random(len(input_pts),num_rndms,seed_num))
        for i in range(len(seeds)):
            seeds[i] = int(seeds[i])
        return seeds
    
    # Context Impact
    def punch(punch_curve,frc):
        in_curve_pts = []
        context_centers = []
        context = []
        _distance = 0
        in_curve_pts.extend(rs.AddPoints(rs.CurvePoints(punch_curve)))
        context.extend(closestBreps(input_context,punch_curve))
        for i in range(len(context)):
            context_centers.append(gh.Volume(context[i])[1])
        for i in range(len(context_centers)):
            closest_id = rs.PointArrayClosestPoint(in_curve_pts,context_centers[i])
            closest_pt = in_curve_pts[closest_id]
            _distance = rs.Distance(context_centers[i],closest_pt)
            vect = rs.VectorCreate(context_centers[i],closest_pt)
            vect1 =rs.CreateVector(vect[0],vect[1],0)
            in_curve_pts[closest_id] = rs.MoveObject(closest_pt,(frc/100)*_distance/1000*vect1)
        output_curve = gh.PolyLine(gh.CullDuplicates(pts_sorter(in_curve_pts),0.1)[0],True)
        return output_curve
    # Rotation
    
    def floor_rotate(r_crvs,base_angle):
        angle = 0
        angle1 = 0
        for i in range(len(r_crvs)):
            if i%2 == 0:
                angle = angle+base_angle
            else:
                angle1 = angle1-base_angle
            r_crvs[i] = rs.RotateObject(r_crvs[i],rs.CurveAreaCentroid(r_crvs[i])[0],angle,rs.CreateVector(0,0,1),False)
        return r_crvs
    ## TOWER STATICS:
    
    #Floor Generator
    def floor_gen(prg_type):
        check = True
        index=[]
        floor_pts=[]
        while check:
            del index[:]
            del floor_pts[:]
            index.extend(rndm(num_corners,int(random.uniform(0,100))))
            for item in index:
                floor_pts.append(input_pts[item])
            floor_pts = pts_sorter(floor_pts)
            temp_floor = gh.PolyLine(floor_pts,True)
            if (rs.CurveArea(temp_floor)[0] < site_area*(const_perc/100)):
                check = False
                break
        if prg_type == 'retail':
            for i in range(1,n_ret):
                floor_retail_outlines.append(rs.CopyObject(temp_floor,rs.CreateVector(0,0,i*h_ret)))
        elif prg_type == 'office':
            for i in range(1,n_ofc):
                floor_office_outlines.append(rs.CopyObject(temp_floor,rs.CreateVector(0,0,i*h_ofc)))
        elif prg_type == 'residential':
            for i in range(1,n_res):
                floor_residential_outlines.append(rs.CopyObject(temp_floor,rs.CreateVector(0,0,i*h_res)))
        elif prg_type == 'public':
            for i in range(1,n_pub):
                floor_public_outlines.append(rs.CopyObject(temp_floor,rs.CreateVector(0,0,i*h_pub)))
        else:
            print("Not a valid program type!")
                
    
    
    # Distributing programs (%40 Residential %30 Office %15 Public/Rec %15 Retail)
    n_ret = int(prg_percentage[3]/100*total_floor_num)
    n_ofc = int(prg_percentage[0]/100*total_floor_num)
    n_pub = int(prg_percentage[1]/100*total_floor_num)
    n_res = int(prg_percentage[2]/100*total_floor_num)
    h_ret = float(prg_heights[3])
    h_pub = float(prg_heights[1])
    h_ofc = float(prg_heights[0])
    h_res = float(prg_heights[2])
    
    
    floor_gen('residential')
    floor_gen('office')
    floor_gen('retail')
    floor_gen('public')

    
    for i in range(len(floor_retail_outlines)):
        floor_retail_outlines[i] = punch(floor_retail_outlines[i],float(force))
        floor_retail_outlines[i] = gh.PolyLine(gh.CleanTree(True,True,True,rs.CurvePoints(gh.FilletDistance(rs.coercecurve(floor_retail_outlines[i]),15))),True)
        rs.CurveDirectionsMatch(floor_retail_outlines[0],floor_office_outlines[i])

    for i in range(len(floor_office_outlines)):
        floor_office_outlines[i] = punch(floor_office_outlines[i],float(force))
        floor_office_outlines[i]= gh.PolyLine(gh.CleanTree(True,True,True,rs.CurvePoints(gh.FilletDistance(rs.coercecurve(floor_office_outlines[i]),15))),True)
        rs.CurveDirectionsMatch(floor_office_outlines[0],floor_office_outlines[i])
    
    
    
    
    for i in range(len(floor_residential_outlines)):
        floor_residential_outlines[i] = punch(floor_residential_outlines[i],float(force))
        floor_residential_outlines[i]= gh.PolyLine(gh.CleanTree(True,True,True,rs.CurvePoints(gh.FilletDistance(rs.coercecurve(floor_residential_outlines[i]),15))),True)
        rs.CurveDirectionsMatch(floor_residential_outlines[0],floor_residential_outlines[i])
    
    
    
    for i in range(int(n_pub/2)):
        floor_public_outlines[i] = punch(floor_public_outlines[i],float(force))
        rs.CurveDirectionsMatch(floor_public_outlines[0],floor_public_outlines[i])
        floor_publicA_outlines.append(gh.PolyLine(gh.CleanTree(True,True,True,rs.CurvePoints(gh.FilletDistance(rs.coercecurve(floor_public_outlines[i]),15))),True))
    
    
    for i in range(int(n_pub/2),len(floor_public_outlines)):
        floor_public_outlines[i] = punch(floor_public_outlines[i],float(force))
        rs.CurveDirectionsMatch(floor_public_outlines[0],floor_public_outlines[i])
        floor_publicB_outlines.append(gh.PolyLine(gh.CleanTree(True,True,True,rs.CurvePoints(gh.FilletDistance(rs.coercecurve(floor_public_outlines[i]),15))),True))
    # Retail
    h1 = int((len(floor_retail_outlines)-1)*h_ret)
    # Retail+PubA
    h2 = int(h1 + (len(floor_publicA_outlines)-1)*h_pub)
    # Retail+PubA+Office
    h3 = int(h2 + (len(floor_office_outlines)-1)*h_ofc)
    h3_b = h3- (len(floor_publicA_outlines))*h_pub
    # Retail+PubA+office+PubB
    h4 = int(h3 + (len(floor_publicB_outlines)-1)*h_pub)
    
    
    rs.MoveObjects(floor_publicA_outlines,rs.CreateVector(0,0,h1))
    rs.MoveObjects(floor_office_outlines,rs.CreateVector(0,0,h2))
    rs.MoveObjects(floor_publicB_outlines,rs.CreateVector(0,0,h3_b))
    rs.MoveObjects(floor_residential_outlines,rs.CreateVector(0,0,h4))
    
    
    
    # Check the centers/ Tower Stability
    
    ret_c = rs.AddPoint(rs.CurveAreaCentroid(floor_retail_outlines[0])[0][0],rs.CurveAreaCentroid(floor_retail_outlines[0])[0][1],0)
    ofc_c = rs.AddPoint(rs.CurveAreaCentroid(floor_office_outlines[0])[0][0],rs.CurveAreaCentroid(floor_office_outlines[0])[0][1],0)
    res_c = rs.AddPoint(rs.CurveAreaCentroid(floor_residential_outlines[0])[0][0],rs.CurveAreaCentroid(floor_residential_outlines[0])[0][1],0)
    pubA_c = rs.AddPoint(rs.CurveAreaCentroid(floor_publicA_outlines[0])[0][0],rs.CurveAreaCentroid(floor_publicA_outlines[0])[0][1],0)
    pubB_c = rs.AddPoint(rs.CurveAreaCentroid(floor_publicB_outlines[0])[0][0],rs.CurveAreaCentroid(floor_publicB_outlines[0])[0][1],0)
    
    if rs.Distance(ret_c,ofc_c) > 15:
        rs.MoveObjects(floor_office_outlines,rs.VectorCreate(ret_c,ofc_c))
    if rs.Distance(ret_c,res_c) > 15:
        rs.MoveObjects(floor_residential_outlines,rs.VectorCreate(ret_c,res_c))
    if rs.Distance(ret_c,pubA_c) > 15:
        rs.MoveObjects(floor_publicA_outlines,rs.VectorCreate(ret_c,pubA_c))
    if rs.Distance(ret_c,pubB_c) > 15:
        rs.MoveObjects(floor_publicB_outlines,rs.VectorCreate(ret_c,pubB_c))
    
    
    floor_retail_outlines = floor_rotate(floor_retail_outlines,rotation_angle)
    floor_office_outlines = floor_rotate(floor_office_outlines,rotation_angle)
    floor_residential_outlines = floor_rotate(floor_residential_outlines,rotation_angle)
    floor_publicA_outlines = floor_rotate(floor_publicA_outlines,rotation_angle)
    floor_publicB_outlines = floor_rotate(floor_publicB_outlines,rotation_angle)
    
    
    ret.extend(gh.CleanTree(True,True,True,floor_retail_outlines))
    ofc.extend(gh.CleanTree(True,True,True,floor_office_outlines))
    res.extend(gh.CleanTree(True,True,True,floor_residential_outlines))
    pub_a.extend(gh.CleanTree(True,True,True,floor_publicA_outlines))
    pub_b.extend(gh.CleanTree(True,True,True,floor_publicB_outlines))
    
    #Tower: Information
    
    print("Construction area : " , float((const_perc*site_area)/100),'\n')
    print("Total Sqft : ")
else:
    print ("Shhhhhhh! Giraffe is sleeping!")
# ---------- end giraffe_2 ----------

baby_giraffe = GhPythonScript(ret=giraffe.ret, ofc=giraffe.ofc, res=giraffe.res)  # -> out, ret_slab, ofc_slab, res_slab, ret_core, ofc_core, res_core; inputs ret: list, ofc: list, res: list; disabled
# ---------- baby_giraffe: Python ----------
__author__ = "milad"
__version__ = "2019.04.16"

import rhinoscriptsyntax as rs
import ghpythonlib.components as gh

ret_slab = []
ofc_slab = []
res_slab = []

#Slab Generator:
def slab_gen(slab_crv,thickness):
    slab = gh.CapHoles(gh.Extrude(rs.coercecurve(slab_crv),rs.CreateVector(0,0,thickness)))
    return slab

for i in range(len(ret)):
    ret_slab.append(slab_gen(ret[i],-1))


for i in range(len(ofc)):
    ofc_slab.append(slab_gen(ofc[i],-1))


for i in range(len(res)):
    res_slab.append(slab_gen(res[i],-1))
# ---------- end baby_giraffe ----------
brep = Brep([baby_giraffe.ret_slab, baby_giraffe.ofc_slab, baby_giraffe.res_slab])  # disabled

number_slider_9 = Slider(30, range=0..100)  # disabled
number_slider_10 = Slider(50, range=0..100)  # disabled
number_slider_11 = Slider(120, range=0..120)  # disabled
number_slider_12 = Slider(12, range=0..12)  # disabled
number_slider_13 = Slider(9, range=0..10)  # disabled

crv_6 = Curve([crv_4, crv_5, crv_2, crv_3, crv])  # disabled
level_elevations = GhPythonScript(floors=crv_6)  # -> out, flatten(floor_heights), floor_centers; inputs floors: list; disabled
# ---------- level_elevations: Python ----------
__author__ = "milad"
__version__ = "2019.04.18"

import rhinoscriptsyntax as rs
import ghpythonlib.components as gh
pts = []
floor_heights = []
floor_centers = []
for i in range(len(floors)):
    floor_centers.append(rs.CurveAreaCentroid(floors[i])[0])
    pts.append(rs.CurvePoints(floors[i]))
    floor_heights.append(gh.Deconstruct(pts[i][0])[2])
# ---------- end level_elevations ----------

number_slider_14 = Slider(0, range=0..59)  # disabled
item = ListItem(List=level_elevations.floor_heights, Index=number_slider_14, Wrap=True)  # disabled
panel_13 = Panel(item)  # disabled

footprint_gen_2 = GhPythonScript(
    site=site_2,
    site_area=area.Area,
    const_perc=number_slider_9,
    in_pts=pop2d,
    shortest_side=number_slider_10,
    longest_side=number_slider_11,
    n_iterations=number_slider_12,
    n_sides=number_slider_13)  # -> out, footprints, selected_pts, simplify(dimensions); inputs in_pts: list, n_sides: Int32; disabled
# ---------- footprint_gen_2: Python ----------
__author__ = "milad"
__version__ = "2020.01.09"

import rhinoscriptsyntax as rs
import ghpythonlib.components as gh
import scriptcontext as sc
import random
import math as mt

#########################################

sc.doc = ghdoc

#########################################

#___Functions____#

def pts_sorter(pts_in):
    
        R_sort = []
        L_sort = []
        upper_pts = []
        lower_pts = []
        sorted_pts = []
        pts_in = rs.coerce3dpointlist(pts_in)
        for i in range(len(pts_in)):
            for j in range(len(pts_in)):
                if gh.Deconstruct(pts_in[i])[0] > gh.Deconstruct(pts_in[j])[0]:
                    temp_L = pts_in[i]
                    pts_in[i] = pts_in[j]
                    pts_in[j] = temp_L
        L_sort = rs.coerce3dpointlist(pts_in)
        
        for i in range(len(pts_in)):
            for j in range(len(pts_in)):
                if gh.Deconstruct(pts_in[i])[0] < gh.Deconstruct(pts_in[j])[0]:
                    temp_R = pts_in[i]
                    pts_in[i] = pts_in[j]
                    pts_in[j] = temp_R
        R_sort =rs.coerce3dpointlist(pts_in)
        if ((gh.Deconstruct(L_sort[1])[0]-gh.Deconstruct(R_sort[0])[0])!=0):
            slope = (gh.Deconstruct(L_sort[0])[1]-gh.Deconstruct(R_sort[0])[1])/(gh.Deconstruct(L_sort[1])[0]-gh.Deconstruct(R_sort[0])[0])
        else:
            slope = 1
        
        for i in range(len(pts_in)):
            y = slope * (gh.Deconstruct(pts_in[i])[0]-gh.Deconstruct(pts_in[0])[0])+gh.Deconstruct(pts_in[0])[1]
            if gh.Deconstruct(pts_in[i])[1] > y:
                upper_pts.append(pts_in[i])
            else:
                lower_pts.append(pts_in[i])
                
        for i in range(len(upper_pts)):
             for j in range(len(upper_pts)):
                 if gh.Deconstruct(upper_pts[i])[0] > gh.Deconstruct(upper_pts[j])[0]:
                     temp_up = upper_pts[i]
                     upper_pts[i] = upper_pts[j]
                     upper_pts[j] = temp_up
        
        for i in range(len(lower_pts)):
             for j in range(len(lower_pts)):
                 if gh.Deconstruct(lower_pts[i])[0] < gh.Deconstruct(lower_pts[j])[0]:
                     temp_down = lower_pts[i]
                     lower_pts[i] = lower_pts[j]
                     lower_pts[j] = temp_down
        
        for i in range(len(upper_pts)):
            sorted_pts.append(upper_pts[i])
        
        for i in range(len(lower_pts)):
            sorted_pts.append(lower_pts[i])
            
        return rs.coerce3dpointlist(sorted_pts)

def distance_check(pts,n_min,n_max):
    d = []
    checked_pts = []
    for i in range(len(pts)):
        for j in range(i,len(pts)):
            if i != j:
                if n_min < gh.Distance(rs.coerce3dpoint(pts[i]),rs.coerce3dpoint(pts[j])) < n_max:
                    d.append(gh.Distance(pts[i],pts[j]))
                    checked_pts.append(pts[i])
                else:
                    continue
    return (checked_pts,d)

def rnd_pt_selector(n_corners,pts_list):
    index = []
    selection = []
    for i in range(n_corners):
        index.append(int(random.uniform(0,len(pts_list))))
    selection.extend(index)
    return selection

def footprint(input_pts):
    fp = []
    dim = []
    s_pts = []
    fp_pts = []
    while len(fp)<n_iterations:
        id = rnd_pt_selector(n_sides,input_pts)
        for item in id:
            s_pts.append(rs.coerce3dpoint(input_pts[item]))
        temp_pts = distance_check(s_pts,shortest_side,longest_side)[0]
        temp_dim = distance_check(s_pts,shortest_side,longest_side)[1]
        print (len(temp_pts),len(s_pts))
        if len(s_pts) == len(temp_pts):
            outline = gh.CurveToPolyline(gh.FilletDistance(gh.PolyLine(pts_sorter(s_pts),True),shortest_side),0.1,mt.radians(90),shortest_side,longest_side)[0]
            if gh.Area(outline)[0] <= site_area*(const_perc/100):
                dim.append(temp_dim)
                fp_pts.append(s_pts)
                fp.append(outline)
            else:
                pass
        else:
            del s_pts[:]
    return(fp_pts,fp,dim)
###########################
selected_pts = footprint(in_pts)[0]
footprints = footprint(in_pts)[1]
dimensions = footprint(in_pts)[2]
# ---------- end footprint_gen_2 ----------
number_slider_15 = Slider(12, range=0..12)  # disabled
number_slider_16 = Slider(1, range=0..100)  # disabled
python = GhPythonScript(x=footprint_gen_2.selected_pts)  # -> out, a; disabled
# ---------- python: Python ----------
__author__ = "milad"
__version__ = "2020.01.12"

import rhinoscriptsyntax as rs

a = x
# ---------- end python ----------
swatch = ColourSwatch(SwatchColor=RGB(66, 62, 62))  # disabled
item_2 = ListItem(List=python.a, Index=number_slider_15, Wrap=True)  # -> simplify(flatten(Item)); disabled
item_3 = ListItem(List=footprint_gen_2.footprints, Index=number_slider_15, Wrap=True)  # disabled
Z = UnitZ(Factor=number_slider_16)  # disabled
python_2 = GhPythonScript(x=footprint_gen_2.dimensions)  # -> out, a; disabled; same code as python
join = BrepJoin(Breps=flatten([cap_3, cap_2, cap_4, cap_5, cap_6]))  # -> Breps, Closed; disabled
extr = Extrude(Base=item_3, Direction=Z)  # disabled
item_4 = ListItem(List=python_2.a, Index=0, Wrap=True)  # -> flatten(Item); disabled

Z_2 = UnitZ(Factor=item)  # disabled
move = Move(Geometry=area.Centroid, Motion=Z_2)  # -> Geometry, Transform; disabled

the_context_2 = Brep(the_context)  # disabled
number_slider_17 = Slider(350, range=0..500)  # disabled
swatch_2 = ColourSwatch(SwatchColor=RGBA(255, 255, 255, 112))  # disabled
preview = CustomPreview(Geometry=the_context_2, Material=swatch_2)  # disabled
viewrose = Ladybug_viewRose(context=the_context_2, plane=move.Geometry, radius=number_slider_17)  # -> readMe, viewRose, blocked, visibleAngle; disabled; plug-in component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

cap_7 = CapHoles(Brep=extr)  # disabled
preview_2 = CustomPreview(Geometry=[item_3, cap_7], Material=swatch)  # disabled
panel_14 = Panel(item_4)  # disabled
number_slider_18 = Slider(174, range=0..1000)  # disabled

fonts = FontTable()  # disabled
panel_15 = Panel(fonts)  # disabled
item_5 = ListItem(List=fonts, Index=number_slider_18, Wrap=True)  # disabled

ladybug = Ladybug_Ladybug()  # -> Vviiiiiiiiiizzz; disabled; plug-in component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

list = ValueList({"Zero": 0, "One": 1, "Two": 2}, selected="Zero")  # disabled
panel_16 = Panel("3")  # disabled
panel_17 = Panel("1")  # disabled

brep_2 = Brep(viewrose.viewRose)  # disabled
number_slider_19 = Slider(15, range=0..100)  # disabled
Z_3 = UnitZ(Factor=number_slider_19)  # disabled
extr_2 = Extrude(Base=brep_2, Direction=Z_3)  # disabled
swatch_3 = ColourSwatch(SwatchColor=RGBA(138, 186, 147, 180))  # disabled
cap_8 = CapHoles(Brep=extr_2)  # disabled
preview_3 = CustomPreview(Geometry=cap_8, Material=swatch_3)  # disabled

brep_3 = Brep(viewrose.blocked)  # disabled
number_slider_20 = Slider(15, range=0..100)  # disabled
Z_4 = UnitZ(Factor=number_slider_20)  # disabled
extr_3 = Extrude(Base=brep_3, Direction=Z_4)  # disabled
swatch_4 = ColourSwatch(SwatchColor=RGBA(207, 101, 101, 180))  # disabled
cap_9 = CapHoles(Brep=extr_3)  # disabled
preview_4 = CustomPreview(Geometry=cap_9, Material=swatch_4)  # disabled

panel_18 = Panel("""9
12
15""")  # disabled
panel_19 = Panel("21")  # disabled
panel_20 = Panel("""6
9
12""")  # disabled

toggle_2 = BooleanToggle(True)  # disabled
toggle_3 = BooleanToggle(True)  # disabled

panel_21 = Panel("2")  # disabled
panel_22 = Panel("0.01")  # disabled

# ----
# June 21
# September 21
# December 21
path = FilePath("C:\UNCC\Diploma Studio\EPW\USA_NC_Charlotte.723140_TMY2.epw")  # disabled
importepw = Ladybug_ImportEpw(epwFile=path)  # -> readMe, latitude, location, dryBulbTemperature, dewPointTemperature, relativeHumidity, windSpeed, windDirection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; disabled; plug-in component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
pt = Point(<point referenced from the Rhino model>)  # disabled
panel_23 = Panel("20")  # disabled
legendpar = Ladybug_LegendParameters(numSegments=panel_23, legendLocation=pt, font=item_5)  # -> legendPar; disabled; plug-in component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
Y = UnitY(Factor=1)  # disabled
sunpath = Ladybug_SunPath(
    north=Y,
    location=importepw.location,
    hour=panel_18,
    day=panel_19,
    month=panel_20,
    timeStep=1,
    sunPathScale=panel_16,
    sunScale=panel_17,
    projection=list,
    legendPar=legendpar,
    dailyOrAnnualSunPath=False,
    bakeIt=0)  # -> readMe, sunVectors, sunAltitudes, sunAzimuths, port, sunSpheresMesh, sunPathCrvs, compassCrvs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; disabled; plug-in component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
sunlighthoursanalysis = Ladybug_SunlightHoursAnalysis(
    north=Y,
    geometry=flatten(join.Breps),
    context=flatten(the_context_2),
    gridSize=panel_21,
    disFromBase=panel_22,
    sunVectors=flatten(sunpath.sunVectors),
    timeStep=1,
    legendPar=flatten(legendpar),
    runIt=toggle_3,
    bakeIt=2)  # -> readMe, contextMesh, analysisMesh, testPts, testVec, port, flatten(sunlightHoursResult), sunlightHoursMesh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; disabled; plug-in component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

panel_24 = Panel(sunlighthoursanalysis.sunlightHoursResult)  # disabled
panel_25 = Panel(sunlighthoursanalysis.totalSunlightHours)  # disabled
mesh = Mesh(sunlighthoursanalysis.sunlightHoursMesh)  # disabled
mesh_2 = Mesh(sunlighthoursanalysis.sunlightHoursLegend)  # disabled

number_slider_21 = Slider(75, range=0..100)  # disabled
panel_26 = Panel("2")  # disabled
path_2 = FilePath("C:\UNCC\Spring 19\Diploma Studio\FINAL REVIEW\Asset 2.jpg")  # disabled
multiplication = Multiplication(A=number_slider_21, B=panel_26)  # disabled
image = CreateImage(ImageSource=path_2, ImageWidth=number_slider_21, ImageHeight=multiplication)  # disabled

panel_27 = Panel("Inro")  # disabled
label = CreateLabel(LabelText=panel_27, LabelSize=18, Justification=0)  # disabled
swatch_5 = ColourSwatch(SwatchColor=RGB(247, 25, 25))  # disabled
adjustelem = AdjustElementAppearance(ElementsToAdjust=label, Foreground=swatch_5)  # disabled

eval = Evaluate(F="X²+3*y²", x=sunlighthoursanalysis.totalSunlightHours, y=viewrose.visibleAngle)

panel_28 = Panel("Giraffe is a multi-varient computational tool that helps architects via providing fast and efficient form finding for a given architectural problem.")  # disabled
tb = CreateTextBlock(Text=panel_28, TextSize=12, Justification=0)  # disabled

panel_29 = Panel("View Analysis")  # disabled
label_2 = CreateLabel(LabelText=panel_29, LabelSize=12, Justification=0)  # disabled
swatch_6 = ColourSwatch(SwatchColor=RGB(247, 25, 25))  # disabled
adjustelem_2 = AdjustElementAppearance(ElementsToAdjust=label_2, Foreground=swatch_6)  # disabled

panel_30 = Panel("View Angle")  # disabled
textbox = CreateTextBox(Label=panel_30, DefaultText=viewrose.visibleAngle, UpdateButton=False, showLabel=True)  # disabled
settextbox = SetTextBoxContents(TextBoxToModify=textbox)  # disabled

panel_31 = Panel("""Visible Angle
Blocked Angle""")  # disabled
panel_32 = Panel("360")  # disabled
panel_33 = Panel("View Analysis")  # disabled
subtraction = Subtraction(A=panel_32, B=viewrose.visibleAngle)  # disabled
chart = CreateChart(Data=[subtraction, viewrose.visibleAngle], Names=panel_31, Title=panel_33, ChartType=0)  # disabled

mesh_3 = Mesh(viewrose.viewRose)  # disabled
_3dview = Create3DView(MeshToDisplay=mesh_3, MeshColors=RGB(255, 0, 0), ViewWidth=300, ViewHeight=300)  # disabled
number_slider_22 = Slider(600, range=0..1000)  # disabled
panel_34 = Panel("Giraffe V1.04")  # disabled
toggle_4 = BooleanToggle(False)  # disabled
launchwin = LaunchWindow(
    Show=toggle_4,
    Name=panel_34,
    Width=number_slider_22,
    Height=number_slider_22,
    FontFamily=item_5,
    ChildStatus=0,
    EnableHorizScroll=False)  # disabled
panel_35 = Panel("Red")  # disabled
addelems = AddElements(Window=launchwin, Elements=flatten([image, label, tb, label_2, textbox, chart, _3dview]), DoVLChecking=True)  # -> AddedElements, ElementNames; disabled
winprops = SetWindowProperties(Window=launchwin, Theme=0, AccentColor=panel_35, ShowTitleBar=True, ScaleFactor=1)  # disabled

opitmization_solver_with_surrogate_model = Opossum(fitness=eval, gene=[rotation_angle, number_slider_3, number_slider_5])  # "Opitmization Solver with Surrogate Models"

# ---- group: Structural Element Generator
crv_7 = Curve(diagrid_3.output_crvs)  # disabled

graft = GraftTree(Tree=crv_7, IncludeEmptyLists=True, IncludeNullItems=True)  # disabled
end = EndPoints(Curve=graft)  # -> Start, End; disabled
eval_2 = EvaluateLength(Curve=graft, Length=1, Normalized=True)  # -> Point, Tangent, Parameter; disabled
vec2pt = Vector2Pt(PointA=end.Start, PointB=eval_2.Point, Unitize=False)  # -> Vector, Length; disabled
number_slider_23 = Slider(0.25, range=0..5.5)  # disabled
pl = PlaneNormal(Origin=end.Start, ZAxis=vec2pt.Vector)  # disabled
rectangle = Rectangle(Plane=pl, XSize=number_slider_23, YSize=number_slider_23, Radius=0)  # -> Rectangle, Length; disabled
swp1 = Sweep1(Rail=graft, Sections=rectangle.Rectangle, Miter=1)  # -> flatten(Brep); disabled

cap_10 = CapHoles(Brep=swp1)  # -> flatten(Brep); disabled
preview_5 = CustomPreview(
    Geometry=cap_10,
    Material={diffuse=RGB(228, 0, 22), emission=RGB(0, 0, 0), shine=0, specular=RGB(255, 255, 255), transparency=0})  # disabled

# ----
panel_36 = Panel("360")  # disabled
division = Division(A=viewrose.visibleAngle, B=panel_36)  # disabled
number_slider_24 = Slider(750, range=0..1000)  # disabled
area_2 = Area(Geometry=brep_2)  # -> Area, Centroid; disabled
number_slider_25 = Slider(100, range=0..100)  # disabled
panel_37 = Panel(division)  # disabled
project = Project(Geometry=area_2.Centroid, Plane=PlaneXY(0, 0, 0))  # -> Geometry, Transform; disabled
Z_5 = UnitZ(Factor=number_slider_24)  # disabled
number_slider_26 = Slider(-40, range=-40..100)  # disabled
move_2 = Move(Geometry=project.Geometry, Motion=Z_5)  # -> Geometry, Transform; disabled
X = UnitX(Factor=number_slider_25)  # disabled
move_3 = Move(Geometry=move_2.Geometry, Motion=X)  # -> Geometry, Transform; disabled
Y_2 = UnitY(Factor=number_slider_26)  # disabled
number_slider_27 = Slider(3, range=0..10)  # disabled
move_4 = Move(Geometry=move_3.Geometry, Motion=Y_2)  # -> Geometry, Transform; disabled
xy = XYPlane(Origin=move_4.Geometry)  # disabled
number_slider_28 = Slider(311, range=0..359)  # disabled
Z_6 = UnitZ(Factor=number_slider_27)  # disabled

# ---- group: Works on PC, Explode doesnt work on Mac, but text gets baked...
number_slider_29 = Slider(20, range=0..30)  # disabled
number_slider_30 = Slider(0, range=0..3)  # disabled
panel_38 = Panel("Avenir")  # disabled
button = Button()  # disabled
python_3 = PythonScript(plane=xy, text=panel_37, font=panel_38, height=number_slider_29, fontStyle=number_slider_30, BAKE=button)  # -> flatten(geoList); inputs plane: Plane, height: Int32, fontStyle: Int32, BAKE: Boolean; disabled
# ---------- python_3: Python ----------
import rhinoscriptsyntax as rs
import scriptcontext as sc
import Rhino as r

sc.doc = r.RhinoDoc.ActiveDoc

geoList = []

preText = rs.AddText(text, plane, height, font, font_style=fontStyle, justification=None) #justification = höger/center/vänsterställd text (int type)
textGeo = rs.ExplodeText(preText, True)

for i in textGeo:
    geoList.append(rs.coercegeometry(i))


for i in textGeo:
    rs.DeleteObject(i)

if BAKE == True:
    bakeText = rs.AddText(text, plane, height, font, font_style=0, justification=None)
# ---------- end python_3 ----------
panel_39 = Panel(python_3)  # disabled

# ----
join_2 = JoinCurves(Curves=python_3, Preserve=False)  # disabled
extr_4 = Extrude(Base=join_2, Direction=Z_6)  # disabled
rotate = Rotate(Geometry=extr_4, Angle=degrees(number_slider_28), Plane=project.Geometry)  # -> Geometry, Transform; disabled
