# Grasshopper definition Giraffe_2019_v421.gh (Grasshopper 1.0.7)
# Copyright: 2019
# plug-ins: Human UI, Human

# ---- group: AREA DISTRIBIUTION OF THE SITE
# 1- FORM GENERATOR
site = Curve(<curve referenced from the Rhino model>)
pop2d = Populate2D(Region=site, Count=Slider(250, range=250..500), Seed=1)
panel = Panel("""25
15
30""")
space_distrbutor = GhPythonScript(prg_prc=panel)  # -> out, Residential_area, Retail_area, Office_area; inputs prg_typs: list, prg_prc: list of Int32
# ---------- space_distrbutor: Python ----------
__author__ = "milad"
__version__ = "2019.03.18"

import rhinoscriptsyntax as rs

t=0
if (len(prg_typs) == len(prg_prc)):
    for i in range(len(prg_prc)):
        t = t+ prg_prc[i]
    if(t<=70):
        Residential_area = site_area*float(prg_prc[0]/100)
        Retail_area = site_area*float(prg_prc[1]/100)
        Office_area = site_area*float(prg_prc[2]/100)
# ---------- end space_distrbutor ----------

area = Area(Geometry=site)  # -> Area, Centroid
panel_2 = Panel(area.Area)

# ----
panel_3 = Panel([Slider(30, range=0..100), Slider(15, range=0..100), Slider(40, range=0..100), Slider(15, range=0..100)])
panel_4 = Panel([Slider(14, range=12..18), Slider(15, range=12..18), Slider(12, range=12..18), Slider(15, range=12..18)])
panel_5 = Panel("""office
public
residential
retail""")
the_context = Brep([<brep referenced from the Rhino model> x136])
rotation_angle = Slider(2.5, range=-5..5)
giraffe = GhPythonScript(
    on_off=Toggle(False),
    const_perc="40",
    site_prem=site,
    input_context=the_context,
    context_range=Slider(250, range=0..1000),
    input_pts=pop2d,
    num_corners="7",
    programs=panel_5,
    total_floor_num=Slider(60, range=0..100),
    seed=Slider(2, range=1..15),
    prg_percentage=panel_3,
    prg_heights=panel_4,
    force=Slider(20, range=0..100),
    rotation_angle=rotation_angle)  # -> out, site_area, site_center, immediate_context, floor_pts, ret, ofc, res, pub_a, pub_b; inputs input_context: list, input_pts: list, programs: list, total_floor_num: Int32, seed: Int32, prg_percentage: list of Int32, prg_heights: list of Int32
# ---------- giraffe: Python ----------
__author__ = "milad"
__version__ = "2019.04.05"

import rhinoscriptsyntax as rs
import ghpythonlib.components as gh

ret = []
ofc = []
res = []
pub_a = []
pub_b = []
floor_retail_outlines = []
floor_residential_outlines = []
floor_public_outlines = []
floor_publicA_outlines = []
floor_publicB_outlines = []
floor_office_outlines = []
core_centers = []
floor_pts = []
index = []

#Site Information
site_area = rs.CurveArea(site_prem)[0]
site_center = rs.CurveAreaCentroid(site_prem)[0]


#Context : Get the information from the context
def closestBreps(breps,crv):
    ref = context_range
    i=0
    brep_centers = []
    sorted_breps = []
    closest_breps =[]
    for i in range(len(breps)):
        brep_centers.append(gh.Volume(rs.coercebrep(breps[i]))[1])
    i=0
    for i in range(len(breps)):
        distance = rs.Distance(gh.Area(rs.coercebrep(breps[i]))[1],rs.CurveAreaCentroid(crv)[0])
        if (distance <= ref):
            index = i
            sorted_breps.append(breps[i])
    i=0
    for i in range(len(sorted_breps)):
        closest_breps.append(rs.coercebrep(sorted_breps[len(sorted_breps)-1-i]))
    return closest_breps

immediate_context = closestBreps(input_context,site_prem)

def pts_sorter(pts_in):

    R_sort = []
    L_sort = []
    upper_pts = []
    lower_pts = []
    sorted_pts = []
    pts_in = rs.coerce3dpointlist(pts_in)
    i=0
    j=0
    for i in range(len(pts_in)):
        for j in range(len(pts_in)):
            if gh.Deconstruct(pts_in[i])[0] > gh.Deconstruct(pts_in[j])[0]:
                temp_L = pts_in[i]
                pts_in[i] = pts_in[j]
                pts_in[j] = temp_L
    L_sort = rs.coerce3dpointlist(pts_in)
    i = 0
    j=0
    
    for i in range(len(pts_in)):
        for j in range(len(pts_in)):
            if gh.Deconstruct(pts_in[i])[0] < gh.Deconstruct(pts_in[j])[0]:
                temp_R = pts_in[i]
                pts_in[i] = pts_in[j]
                pts_in[j] = temp_R
    R_sort =rs.coerce3dpointlist(pts_in)
    
    slope = (gh.Deconstruct(L_sort[0])[1]-gh.Deconstruct(R_sort[0])[1])/(gh.Deconstruct(L_sort[1])[0]-gh.Deconstruct(R_sort[0])[0])
    i=0
    j=0
    
    for i in range(len(pts_in)):
        y = slope * (gh.Deconstruct(pts_in[i])[0]-gh.Deconstruct(pts_in[0])[0])+gh.Deconstruct(pts_in[0])[1]
        if gh.Deconstruct(pts_in[i])[1] > y:
            upper_pts.append(pts_in[i])
        else:
            lower_pts.append(pts_in[i])
            
    for i in range(len(upper_pts)):
         for j in range(len(upper_pts)):
             if gh.Deconstruct(upper_pts[i])[0] > gh.Deconstruct(upper_pts[j])[0]:
                 temp_up = upper_pts[i]
                 upper_pts[i] = upper_pts[j]
                 upper_pts[j] = temp_up
    i=0
    j=0
    
    for i in range(len(lower_pts)):
         for j in range(len(lower_pts)):
             if gh.Deconstruct(lower_pts[i])[0] < gh.Deconstruct(lower_pts[j])[0]:
                 temp_down = lower_pts[i]
                 lower_pts[i] = lower_pts[j]
                 lower_pts[j] = temp_down
    i=0
    j=0
    
    for i in range(len(upper_pts)):
        sorted_pts.append(upper_pts[i])
    i=0
    
    for i in range(len(lower_pts)):
        sorted_pts.append(lower_pts[i])
        
    return rs.coerce3dpointlist(sorted_pts)



#Tower: Random Floor Generator

def rndm(num_rndms,seed_num):
    seeds = []
    seeds.extend(gh.Random(len(input_pts),num_rndms,seed_num))
    i=0
    for i in range(len(seeds)):
        seeds[i] = int(seeds[i])
    return seeds

# Context Impact
def punch(punch_curve,frc):
    in_curve_pts = []
    context_centers = []
    context = []
    i=0
    j=0
    _distance = 0
    in_curve_pts.extend(rs.AddPoints(rs.CurvePoints(punch_curve)))

    context.extend(closestBreps(input_context,punch_curve))
    i=0
    for i in range(len(context)):
        context_centers.append(gh.Volume(context[i])[1])
    i=0
    for i in range(len(context_centers)):
        closest_id = rs.PointArrayClosestPoint(in_curve_pts,context_centers[i])
        closest_pt = in_curve_pts[closest_id]
        _distance = rs.Distance(context_centers[i],closest_pt)
        vect = rs.VectorCreate(context_centers[i],closest_pt)
        vect1 =rs.CreateVector(vect[0],vect[1],0)
        in_curve_pts[closest_id] = rs.MoveObject(closest_pt,(frc/100)*_distance/1000*vect1)
    output_curve = gh.PolyLine(pts_sorter(in_curve_pts),True)
    return output_curve

# Rotation

def floor_rotate (r_crvs,base_angle):
    angle = 0
    angle1 = 0
    for i in range(len(r_crvs)):
        if i%2 == 0:
            angle = angle+base_angle
        else:
            angle1 = angle1-base_angle
        r_crvs[i] = rs.RotateObject(r_crvs[i],rs.CurveAreaCentroid(r_crvs[i])[0],angle,rs.CreateVector(0,0,1),False)
    return r_crvs
## TOWER STATICS:

#Floor Generator

# Distributing programs (%40 Residential %30 Office %15 Public/Rec %15 Retail)

for i in range(len(programs)):
    n_ret = int(prg_percentage[3]/100*total_floor_num)
    h_ret = float(prg_heights[3])
    n_ofc = int(prg_percentage[0]/100*total_floor_num)
    h_ofc = float(prg_heights[0])
    n_pub = int(prg_percentage[1]/100*total_floor_num)
    h_pub = float(prg_heights[1])
    n_res = int(prg_percentage[2]/100*total_floor_num)
    h_res = float(prg_heights[2])
    if programs[i] == 'retail':
        index.extend(rndm(num_corners,seed+i))
        for j in range(len(index)):
            floor_pts.append(input_pts[index[j]])
        floor_pts = pts_sorter(rs.coerceguidlist(floor_pts))
        floor_pts.append(floor_pts[0])
        floor_retail_outlines.append((rs.AddPolyline(floor_pts)))
        i=0
        for i in range(1,n_ret):
            floor_retail_outlines.append(rs.CopyObject(floor_retail_outlines[0],rs.CreateVector(0,0,i*h_ret)))
    elif programs[i] == 'office':
        index.extend(rndm(num_corners,seed+i))
        for j in range(len(index)):
            floor_pts.append(input_pts[index[j]])
        floor_pts = pts_sorter(floor_pts)
        floor_pts.append(floor_pts[0])
        floor_office_outlines.append((rs.AddPolyline(floor_pts)))
        i=0
        for i in range(1,n_ofc):
            floor_office_outlines.append(rs.CopyObject(floor_office_outlines[0],rs.CreateVector(0,0,i*h_ofc)))
    elif programs[i] == 'residential':
        index.extend(rndm(num_corners,seed+i))
        for j in range(len(index)):
            floor_pts.append(input_pts[index[j]])
        floor_pts = pts_sorter(rs.coerceguidlist(floor_pts))
        floor_pts.append(floor_pts[0])
        floor_residential_outlines.append((rs.AddPolyline(floor_pts)))
        for i in range(1,n_res):
            floor_residential_outlines.append(rs.CopyObject(floor_residential_outlines[0],rs.CreateVector(0,0,i*h_res)))
    elif programs[i] == 'public':
        index.extend(rndm(num_corners,seed+i))
        for j in range(len(index)):
            floor_pts.append(input_pts[index[j]])
        floor_pts = pts_sorter(rs.coerceguidlist(floor_pts))
        floor_pts.append(floor_pts[0])
        floor_public_outlines.append((rs.AddPolyline(floor_pts)))
        for i in range(1,n_pub):
            floor_public_outlines.append(rs.CopyObject(floor_public_outlines[0],rs.CreateVector(0,0,i*h_pub)))
    else:
        print("Not a valid program type!")




index.extend(rndm(7,3))



for i in range(len(floor_retail_outlines)):
    floor_retail_outlines[i] = punch(floor_retail_outlines[i],float(force))
    floor_retail_outlines[i] = rs.AddPolyline(rs.CurvePoints(gh.FilletDistance(rs.coercecurve(floor_retail_outlines[i]),15)))
    rs.CurveDirectionsMatch(floor_retail_outlines[0],floor_office_outlines[i])




for i in range(len(floor_office_outlines)):
    floor_office_outlines[i] = punch(floor_office_outlines[i],float(force))
    floor_office_outlines[i]= rs.AddPolyline(rs.CurvePoints(gh.FilletDistance(rs.coercecurve(floor_office_outlines[i]),15)))
    rs.CurveDirectionsMatch(floor_office_outlines[0],floor_office_outlines[i])




for i in range(len(floor_residential_outlines)):
    floor_residential_outlines[i] = punch(floor_residential_outlines[i],float(force))
    floor_residential_outlines[i]= rs.AddPolyline(rs.CurvePoints(gh.FilletDistance(rs.coercecurve(floor_residential_outlines[i]),15)))
    rs.CurveDirectionsMatch(floor_residential_outlines[0],floor_residential_outlines[i])



for i in range(int(n_pub/2)):
    floor_public_outlines[i] = punch(floor_public_outlines[i],float(force))
    rs.CurveDirectionsMatch(floor_public_outlines[0],floor_public_outlines[i])
    floor_publicA_outlines.append(rs.AddPolyline(rs.CurvePoints(gh.FilletDistance(rs.coercecurve(floor_public_outlines[i]),15))))


for i in range(int(n_pub/2),len(floor_public_outlines)):
    floor_public_outlines[i] = punch(floor_public_outlines[i],float(force))
    rs.CurveDirectionsMatch(floor_public_outlines[0],floor_public_outlines[i])
    floor_publicB_outlines.append(rs.AddPolyline(rs.CurvePoints(gh.FilletDistance(rs.coercecurve(floor_public_outlines[i]),15))))
# Retail
h1 = int((len(floor_retail_outlines)-1)*h_ret)
# Retail+PubA
h2 = int(h1 + (len(floor_publicA_outlines)-1)*h_pub)
# Retail+PubA+Office
h3 = int(h2 + (len(floor_office_outlines)-1)*h_ofc)
h3_b = h3- (len(floor_publicA_outlines))*h_pub
# Retail+PubA+office+PubB
h4 = int(h3 + (len(floor_publicB_outlines)-1)*h_pub)

print (h1,h2,h3,h4)

rs.MoveObjects(floor_publicA_outlines,rs.CreateVector(0,0,h1))
rs.MoveObjects(floor_office_outlines,rs.CreateVector(0,0,h2))
rs.MoveObjects(floor_publicB_outlines,rs.CreateVector(0,0,h3_b))
rs.MoveObjects(floor_residential_outlines,rs.CreateVector(0,0,h4))



# Check the centers/ Tower Stability

ret_c = rs.AddPoint(rs.CurveAreaCentroid(floor_retail_outlines[0])[0][0],rs.CurveAreaCentroid(floor_retail_outlines[0])[0][1],0)
ofc_c = rs.AddPoint(rs.CurveAreaCentroid(floor_office_outlines[0])[0][0],rs.CurveAreaCentroid(floor_office_outlines[0])[0][1],0)
res_c = rs.AddPoint(rs.CurveAreaCentroid(floor_residential_outlines[0])[0][0],rs.CurveAreaCentroid(floor_residential_outlines[0])[0][1],0)
pubA_c = rs.AddPoint(rs.CurveAreaCentroid(floor_publicA_outlines[0])[0][0],rs.CurveAreaCentroid(floor_publicA_outlines[0])[0][1],0)
pubB_c = rs.AddPoint(rs.CurveAreaCentroid(floor_publicB_outlines[0])[0][0],rs.CurveAreaCentroid(floor_publicB_outlines[0])[0][1],0)

if rs.Distance(ret_c,ofc_c) > 15:
    rs.MoveObjects(floor_office_outline,rs.VectorCreate(ret_c,ofc_c))
if rs.Distance(ret_c,res_c) > 15:
    rs.MoveObjects(floor_residential_outline,rs.VectorCreate(ret_c,res_c))
if rs.Distance(ret_c,pubA_c) > 15:
    rs.MoveObjects(floor_publicA_outline,rs.VectorCreate(ret_c,pubA_c))
if rs.Distance(ret_c,pubB_c) > 15:
    rs.MoveObjects(floor_publicB_outline,rs.VectorCreate(ret_c,pubB_c))


floor_retail_outlines = floor_rotate(floor_retail_outlines,rotation_angle)
floor_office_outlines = floor_rotate(floor_office_outlines,rotation_angle)
floor_residential_outlines = floor_rotate(floor_residential_outlines,rotation_angle)
floor_publicA_outlines = floor_rotate(floor_publicA_outlines,rotation_angle)
floor_publicB_outlines = floor_rotate(floor_publicB_outlines,rotation_angle)


ret.extend(floor_retail_outlines)
ofc.extend(floor_office_outlines)
res.extend(floor_residential_outlines)
pub_a.extend(floor_publicA_outlines)
pub_b.extend(floor_publicB_outlines)

#Tower: Information

print("Construction area : ")
print("Total Sqft : ")
print '\t'
print len(floor_retail_outlines)
# ---------- end giraffe ----------
brep = Brep(giraffe.immediate_context)
panel_6 = Panel(giraffe.out)

# ---- group: Structure Diagrid
number_slider = Slider(16, range=0..100)  # disabled
number_slider_2 = Slider(60, range=0..100)  # disabled
number_slider_3 = Slider(72, range=0..100)  # disabled
diagrid = GhPythonScript(input_crvs=giraffe.res, number=number_slider)  # -> out, output_crvs; inputs input_crvs: list; disabled
# ---------- diagrid: Python ----------
__author__ = "milad"
__version__ = "2019.04.15"

import rhinoscriptsyntax as rs
import ghpythonlib.components as gh

crv_pts = []
lines = []
for i in range(len(input_crvs)-1):
    crv_pts.append(rs.DivideCurve(input_crvs[i],number,True,True))
    crv_pts.append(rs.DivideCurve(input_crvs[i+1],number,True,True))
i=0
for i in range(len(crv_pts)-1):
    if i%2 ==0:
        for j in range(len(crv_pts[i])-1):
            lines.append(rs.AddLine(crv_pts[i][j],crv_pts[i+1][j-1]))
            lines.append(rs.AddLine(crv_pts[i][j],crv_pts[i+1][j+1]))
#    else:
#        for j in range(len(crv_pts[i+1])-1):
#            lines.append(rs.AddLine(crv_pts[i][j],crv_pts[i+1][j]))

output_crvs = lines
# ---------- end diagrid ----------
diagrid_2 = GhPythonScript(input_crvs=giraffe.ofc, number=number_slider_2)  # -> out, output_crvs; inputs input_crvs: list; disabled; same code as diagrid
diagrid_3 = GhPythonScript(input_crvs=giraffe.ret, number=number_slider_3)  # -> out, output_crvs; inputs input_crvs: list; disabled; same code as diagrid

# ----
crv = Curve(giraffe.res)
crv_2 = Curve(giraffe.ofc)
crv_3 = Curve(giraffe.pub_b)
crv_4 = Curve(giraffe.ret)
crv_5 = Curve(giraffe.pub_a)
loft = Loft(Curves=crv, Options={Adjust=True, Closed=False, LoftEnds=0, LoftSimp=0, LoftType=3, Rebuild=10, Refit=0.01})
loft_2 = Loft(Curves=crv_3, Options={Adjust=True, Closed=False, LoftEnds=0, LoftSimp=0, LoftType=3, Rebuild=10, Refit=0.01})
loft_3 = Loft(Curves=crv_2, Options={Adjust=True, Closed=False, LoftEnds=0, LoftSimp=0, LoftType=3, Rebuild=10, Refit=0.01})
loft_4 = Loft(Curves=crv_5, Options={Adjust=True, Closed=False, LoftEnds=0, LoftSimp=0, LoftType=3, Rebuild=10, Refit=0.01})
loft_5 = Loft(Curves=crv_4, Options={Adjust=True, Closed=False, LoftEnds=0, LoftSimp=0, LoftType=3, Rebuild=10, Refit=0.01})
cap = CapHoles(Brep=loft_2)
cap_2 = CapHoles(Brep=loft)
cap_3 = CapHoles(Brep=loft_3)
cap_4 = CapHoles(Brep=loft_4)
cap_5 = CapHoles(Brep=loft_5)

baby_giraffe = GhPythonScript(ret=giraffe.ret, ofc=giraffe.ofc, res=giraffe.res)  # -> out, ret_slab, ofc_slab, res_slab, ret_core, ofc_core, res_core; inputs ret: list, ofc: list, res: list
# ---------- baby_giraffe: Python ----------
__author__ = "milad"
__version__ = "2019.04.16"

import rhinoscriptsyntax as rs
import ghpythonlib.components as gh

ret_slab = []
ofc_slab = []
res_slab = []

#Slab Generator:
def slab_gen(slab_crv,thickness):
    slab = gh.CapHoles(gh.Extrude(rs.coercecurve(slab_crv),rs.CreateVector(0,0,thickness)))
    return slab

for i in range(len(ret)):
    ret_slab.append(slab_gen(ret[i],-1))


for i in range(len(ofc)):
    ofc_slab.append(slab_gen(ofc[i],-1))


for i in range(len(res)):
    res_slab.append(slab_gen(res[i],-1))
# ---------- end baby_giraffe ----------
brep_2 = Brep([baby_giraffe.ret_slab, baby_giraffe.ofc_slab, baby_giraffe.res_slab])  # disabled

crv_6 = Curve([crv_4, crv_5, crv_2, crv_3, crv])
level_elevations = GhPythonScript(floors=crv_6)  # -> out, flatten(floor_heights), floor_centers; inputs floors: list
# ---------- level_elevations: Python ----------
__author__ = "milad"
__version__ = "2019.04.18"

import rhinoscriptsyntax as rs
import ghpythonlib.components as gh
pts = []
floor_heights = []
floor_centers = []
for i in range(len(floors)):
    floor_centers.append(rs.CurveAreaCentroid(floors[i])[0])
    pts.append(rs.CurvePoints(floors[i]))
    floor_heights.append(gh.Deconstruct(pts[i][0])[2])
# ---------- end level_elevations ----------

item = ListItem(List=level_elevations.floor_heights, Index=Slider(12, range=0..59), Wrap=True)
panel_7 = Panel(item)

join = BrepJoin(Breps=flatten([cap_2, cap, cap_3, cap_4, cap_5]))  # -> Breps, Closed

Z = UnitZ(Factor=item)
move = Move(Geometry=area.Centroid, Motion=Z)  # -> Geometry, Transform

fonts = FontTable()
panel_8 = Panel(fonts)
item_2 = ListItem(List=fonts, Index=Slider(174, range=0..1000), Wrap=True)

the_context_2 = Brep([<brep referenced from the Rhino model> x136])
preview = CustomPreview(Geometry=the_context_2, Material=ColourSwatch(SwatchColor=RGBA(255, 255, 255, 112)))  # disabled
viewrose = Ladybug_viewRose(context=the_context_2, plane=move.Geometry, radius=Slider(350, range=0..500))  # -> readMe, viewRose, blocked, visibleAngle; plug-in component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

list = ValueList({"Zero": 0, "One": 1, "Two": 2}, selected="Zero")

brep_3 = Brep(viewrose.viewRose)
Z_2 = UnitZ(Factor=Slider(15, range=0..100))
extr = Extrude(Base=brep_3, Direction=Z_2)
cap_6 = CapHoles(Brep=extr)
preview_2 = CustomPreview(Geometry=cap_6, Material=ColourSwatch(SwatchColor=RGBA(138, 176, 186, 100)))

brep_4 = Brep(viewrose.blocked)
Z_3 = UnitZ(Factor=Slider(15, range=0..100))
extr_2 = Extrude(Base=brep_4, Direction=Z_3)
cap_7 = CapHoles(Brep=extr_2)
preview_3 = CustomPreview(Geometry=cap_7, Material=ColourSwatch(SwatchColor=RGBA(207, 101, 101, 100)))

panel_9 = Panel("""9
12
15""")
panel_10 = Panel("""6
9
12""")

toggle = BooleanToggle(False)

# ----
# June 21
# September 21
# December 21
path = FilePath("C:\UNCC\Spring 19\Diploma Studio\EPW\USA_NC_Charlotte.723140_TMY2.epw")
importepw = Ladybug_ImportEpw(epwFile=path)  # -> readMe, latitude, location, dryBulbTemperature, dewPointTemperature, relativeHumidity, windSpeed, windDirection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; plug-in component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
ladybug = Ladybug_Ladybug()  # -> Vviiiiiiiiiizzz; plug-in component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
pt = Point(<point referenced from the Rhino model>)
legendpar = Ladybug_LegendParameters(numSegments="20", legendLocation=pt, font=item_2)  # -> legendPar; plug-in component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
Y = UnitY(Factor=1)
sunpath = Ladybug_SunPath(
    north=Y,
    location=importepw.location,
    hour=panel_9,
    day="21",
    month=panel_10,
    timeStep=1,
    sunPathScale="3",
    sunScale="1",
    projection=list,
    legendPar=legendpar,
    dailyOrAnnualSunPath=False)  # -> readMe, sunVectors, sunAltitudes, sunAzimuths, port, sunSpheresMesh, sunPathCrvs, compassCrvs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; plug-in component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
sunlighthoursanalysis = Ladybug_SunlightHoursAnalysis(
    north=Y,
    geometry=flatten(join.Breps),
    context=flatten(the_context_2),
    gridSize="2",
    disFromBase="0.01",
    sunVectors=flatten(sunpath.sunVectors),
    timeStep=1,
    legendPar=flatten(legendpar),
    runIt=Toggle(True))  # -> readMe, contextMesh, analysisMesh, testPts, testVec, port, flatten(sunlightHoursResult), sunlightHoursMesh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; plug-in component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

panel_11 = Panel(sunlighthoursanalysis.totalSunlightHours)
panel_12 = Panel(sunlighthoursanalysis.sunlightHoursResult)
mesh = Mesh(sunlighthoursanalysis.sunlightHoursMesh)
mesh_2 = Mesh(sunlighthoursanalysis.sunlightHoursLegend)

number_slider_4 = Slider(75, range=0..100)
path_2 = FilePath("C:\UNCC\Spring 19\Diploma Studio\FINAL REVIEW\Asset 2.jpg")
multiplication = Multiplication(A=number_slider_4, B="2")
image = CreateImage(ImageSource=path_2, ImageWidth=number_slider_4, ImageHeight=multiplication)

label = CreateLabel(LabelText="Inro", LabelSize=18, Justification=0)
adjustelem = AdjustElementAppearance(ElementsToAdjust=label, Foreground=ColourSwatch(SwatchColor=RGB(247, 25, 25)))

panel_13 = Panel("Giraffe is a multi-varient computational tool that helps architects via providing fast and efficient form finding for a given architectural problem.")
tb = CreateTextBlock(Text=panel_13, TextSize=12, Justification=0)

label_2 = CreateLabel(LabelText="View Analysis", LabelSize=12, Justification=0)
adjustelem_2 = AdjustElementAppearance(ElementsToAdjust=label_2, Foreground=ColourSwatch(SwatchColor=RGB(247, 25, 25)))

textbox = CreateTextBox(Label="View Angle", DefaultText=viewrose.visibleAngle, UpdateButton=False, showLabel=True)
settextbox = SetTextBoxContents(TextBoxToModify=textbox)

panel_14 = Panel("""Visible Angle
Blocked Angle""")
subtraction = Subtraction(A="360", B=viewrose.visibleAngle)
chart = CreateChart(Data=[subtraction, viewrose.visibleAngle], Names=panel_14, Title="View Analysis", ChartType=0)

mesh_3 = Mesh(viewrose.viewRose)
_3dview = Create3DView(MeshToDisplay=mesh_3, MeshColors=RGB(255, 0, 0), ViewWidth=300, ViewHeight=300)
number_slider_5 = Slider(600, range=0..1000)
launchwin = LaunchWindow(
    Show=Toggle(False),
    Name="Giraffe V1.04",
    Width=number_slider_5,
    Height=number_slider_5,
    FontFamily=item_2,
    ChildStatus=0,
    EnableHorizScroll=False)
addelems = AddElements(Window=launchwin, Elements=flatten([image, label, tb, label_2, textbox, chart, _3dview]), DoVLChecking=True)  # -> AddedElements, ElementNames
winprops = SetWindowProperties(Window=launchwin, Theme=0, AccentColor="Red", ShowTitleBar=True, ScaleFactor=1)

# ---- group: Structural Element Generator
crv_7 = Curve(diagrid_3.output_crvs)  # disabled

graft = GraftTree(Tree=crv_7, IncludeEmptyLists=True, IncludeNullItems=True)  # disabled
end = EndPoints(Curve=graft)  # -> Start, End; disabled
eval = EvaluateLength(Curve=graft, Length=1, Normalized=True)  # -> Point, Tangent, Parameter; disabled
vec2pt = Vector2Pt(PointA=end.Start, PointB=eval.Point, Unitize=False)  # -> Vector, Length; disabled
number_slider_6 = Slider(0.25, range=0..5.5)  # disabled
pl = PlaneNormal(Origin=end.Start, ZAxis=vec2pt.Vector)  # disabled
rectangle = Rectangle(Plane=pl, XSize=number_slider_6, YSize=number_slider_6, Radius=0)  # -> Rectangle, Length; disabled
swp1 = Sweep1(Rail=graft, Sections=rectangle.Rectangle, Miter=1)  # -> flatten(Brep); disabled

cap_8 = CapHoles(Brep=swp1)  # -> flatten(Brep); disabled
preview_4 = CustomPreview(
    Geometry=cap_8,
    Material={diffuse=RGB(228, 0, 22), emission=RGB(0, 0, 0), shine=0, specular=RGB(255, 255, 255), transparency=0})  # disabled

# ----
division = Division(A=viewrose.visibleAngle, B="360")
area_2 = Area(Geometry=brep_3)  # -> Area, Centroid
panel_15 = Panel(division)
project = Project(Geometry=area_2.Centroid, Plane=PlaneXY(0, 0, 0))  # -> Geometry, Transform
Z_4 = UnitZ(Factor=Slider(750, range=0..1000))
move_2 = Move(Geometry=project.Geometry, Motion=Z_4)  # -> Geometry, Transform
X = UnitX(Factor=Slider(100, range=0..100))
move_3 = Move(Geometry=move_2.Geometry, Motion=X)  # -> Geometry, Transform
Y_2 = UnitY(Factor=Slider(-40, range=-40..100))
move_4 = Move(Geometry=move_3.Geometry, Motion=Y_2)  # -> Geometry, Transform
xy = XYPlane(Origin=move_4.Geometry)
Z_5 = UnitZ(Factor=Slider(3, range=0..10))

# ---- group: Works on PC, Explode doesnt work on Mac, but text gets baked...
python = PythonScript(plane=xy, text=panel_15, font="Avenir", height=Slider(20, range=0..30), fontStyle=Slider(0, range=0..3), BAKE=Button())  # -> flatten(geoList); inputs plane: Plane, height: Int32, fontStyle: Int32, BAKE: Boolean
# ---------- python: Python ----------
import rhinoscriptsyntax as rs
import scriptcontext as sc
import Rhino as r

sc.doc = r.RhinoDoc.ActiveDoc

geoList = []

preText = rs.AddText(text, plane, height, font, font_style=fontStyle, justification=None) #justification = höger/center/vänsterställd text (int type)
textGeo = rs.ExplodeText(preText, True)

for i in textGeo:
    geoList.append(rs.coercegeometry(i))


for i in textGeo:
    rs.DeleteObject(i)

if BAKE == True:
    bakeText = rs.AddText(text, plane, height, font, font_style=0, justification=None)
# ---------- end python ----------
panel_16 = Panel(python)

# ----
join_2 = JoinCurves(Curves=python, Preserve=False)
extr_3 = Extrude(Base=join_2, Direction=Z_5)
rotate = Rotate(Geometry=extr_3, Angle=degrees(Slider(311, range=0..359)), Plane=project.Geometry)  # -> Geometry, Transform
