# Grasshopper definition Giraffe_v0428.gh (Grasshopper 1.0.7)
# Copyright: 2019

major_group = ColourSwatch(SwatchColor=RGB(191, 119, 119))
input_component = ColourSwatch(SwatchColor=RGB(169, 191, 119))
output_component = ColourSwatch(SwatchColor=RGB(119, 185, 191))
groups = ColourSwatch(SwatchColor=RGB(255, 255, 255))

panel = Panel("""10
40
20
30""")
context = Brep([<brep referenced from the Rhino model> x3])
panel_2 = Panel("""retail
residential
public
office""")
site = Curve(<curve referenced from the Rhino model>)
panel_3 = Panel("""14
12
15
12""")
pop2d = Populate2D(Region=site, Count=Slider(250, range=0..250), Seed=1)

giraffe = GhPythonScript(
    on_off=Toggle(True),
    const_perc="60",
    site_prem=site,
    input_context=context,
    context_range=Slider(350, range=0..1000),
    input_pts=pop2d,
    num_corners="7",
    programs=flatten(panel_2),
    total_floor_num=Slider(50, range=0..100),
    seed=Slider(1, range=0..25),
    prg_percentage=flatten(panel),
    prg_heights=flatten(panel_3),
    rotation_angle=Slider(0.5, range=0..10))  # -> site_area, site_center, immediate_context, floor_pts, ret, ofc, res, pub_a, pub_b; inputs const_perc: Int32, input_context: list, input_pts: list of Point3d, programs: list, total_floor_num: Int32, seed: Int32, prg_percentage: list of Int32, prg_heights: list of Int32
# ---------- giraffe: Python ----------
from ghpythonlib.componentbase import executingcomponent as component
import Grasshopper, GhPython
import System
import Rhino
import rhinoscriptsyntax as rs

class MyComponent(component):
    
    def RunScript(self, on_off, site_north, const_perc, site_prem, input_context, context_range, input_pts, num_corners, programs, total_floor_num, seed, prg_percentage, prg_heights, force, rotation_angle):
        """Provides a scripting component.
            Inputs:
                x: The x script variable
                y: The y script variable
            Output:
                a: The a output variable"""
                
        __author__ = "milad"
        __version__ = "2019.04.05"
                
        import rhinoscriptsyntax as rs
        import ghpythonlib.components as gh
                
        ret = []
        ofc = []
        res = []
        pub_a = []
        pub_b = []
        floor_retail_outlines = []
        floor_residential_outlines = []
        floor_public_outlines = []
        floor_publicA_outlines = []
        floor_publicB_outlines = []
        floor_office_outlines = []
        core_centers = []
        floor_pts = []
        index = []
                
        if on_off == True:
                
            #Site Information
            site_area = rs.CurveArea(site_prem)[0]
            site_center = rs.CurveAreaCentroid(site_prem)[0]
                    
                    
            #Context : Get the information from the context
            def closestBreps(breps,crv):
                ref = context_range
                brep_centers = []
                sorted_breps = []
                closest_breps =[]
                for i in range(len(breps)):
                    brep_centers.append(gh.Volume(rs.coercebrep(breps[i]))[1])
                for i in range(len(breps)):
                    distance = rs.Distance(gh.Area(rs.coercebrep(breps[i]))[1],rs.CurveAreaCentroid(crv)[0])
                    if (distance <= ref):
                        index = i
                        sorted_breps.append(breps[i])
                for i in range(len(sorted_breps)):
                    closest_breps.append(rs.coercebrep(sorted_breps[len(sorted_breps)-1-i]))
                return closest_breps
                    
            def pts_sorter(pts_in):
                    
                R_sort = []
                L_sort = []
                upper_pts = []
                lower_pts = []
                sorted_pts = []
                pts_in = rs.coerce3dpointlist(pts_in)
                for i in range(len(pts_in)):
                    for j in range(len(pts_in)):
                        if gh.Deconstruct(pts_in[i])[0] > gh.Deconstruct(pts_in[j])[0]:
                            temp_L = pts_in[i]
                            pts_in[i] = pts_in[j]
                            pts_in[j] = temp_L
                L_sort = rs.coerce3dpointlist(pts_in)
                for i in range(len(pts_in)):
                    for j in range(len(pts_in)):
                        if gh.Deconstruct(pts_in[i])[0] < gh.Deconstruct(pts_in[j])[0]:
                            temp_R = pts_in[i]
                            pts_in[i] = pts_in[j]
                            pts_in[j] = temp_R
                R_sort =rs.coerce3dpointlist(pts_in)
                if ((gh.Deconstruct(L_sort[1])[0]-gh.Deconstruct(R_sort[0])[0])!=0):
                    slope = (gh.Deconstruct(L_sort[0])[1]-gh.Deconstruct(R_sort[0])[1])/(gh.Deconstruct(L_sort[1])[0]-gh.Deconstruct(R_sort[0])[0])
                else:
                    slope = 1
                i=0
                j=0
                        
                for i in range(len(pts_in)):
                    y = slope * (gh.Deconstruct(pts_in[i])[0]-gh.Deconstruct(pts_in[0])[0])+gh.Deconstruct(pts_in[0])[1]
                    if gh.Deconstruct(pts_in[i])[1] > y:
                        upper_pts.append(pts_in[i])
                    else:
                        lower_pts.append(pts_in[i])
                                
                for i in range(len(upper_pts)):
                     for j in range(len(upper_pts)):
                         if gh.Deconstruct(upper_pts[i])[0] > gh.Deconstruct(upper_pts[j])[0]:
                             temp_up = upper_pts[i]
                             upper_pts[i] = upper_pts[j]
                             upper_pts[j] = temp_up
                i=0
                j=0
                        
                for i in range(len(lower_pts)):
                     for j in range(len(lower_pts)):
                         if gh.Deconstruct(lower_pts[i])[0] < gh.Deconstruct(lower_pts[j])[0]:
                             temp_down = lower_pts[i]
                             lower_pts[i] = lower_pts[j]
                             lower_pts[j] = temp_down
                i=0
                j=0
                        
                for i in range(len(upper_pts)):
                    sorted_pts.append(upper_pts[i])
                i=0
                        
                for i in range(len(lower_pts)):
                    sorted_pts.append(lower_pts[i])
                            
                return rs.coerce3dpointlist(sorted_pts)
                    
                    
            immediate_context = closestBreps(input_context,site_prem)
                    
                    
            #Tower: Random Floor Generator
                    
            def rndm(num_rndms,seed_num):
                seeds = []
                seeds.extend(gh.Random(len(input_pts),num_rndms,seed_num))
                i=0
                for i in range(len(seeds)):
                    seeds[i] = int(seeds[i])
                return seeds
                    
            # Context Impact
            def punch(punch_curve,frc):
                in_curve_pts = []
                context_centers = []
                context = []
                _distance = 0
                in_curve_pts.extend(rs.coerceguidlist(rs.coerce3dpointlist(rs.CurvePoints(punch_curve))))
                context.extend(closestBreps(input_context,punch_curve))
                for i in range(len(context)):
                    context_centers.append(gh.Volume(context[i])[1])
                for i in range(len(context_centers)):
                    closest_id = rs.PointArrayClosestPoint(in_curve_pts,context_centers[i])
                    closest_pt = in_curve_pts[closest_id]
                    _distance = rs.Distance(context_centers[i],closest_pt)
                    vect = rs.VectorCreate(context_centers[i],closest_pt)
                    vect1 =rs.CreateVector(vect[0],vect[1],0)
                    in_curve_pts[closest_id] = rs.MoveObject(closest_pt,(frc/100)*_distance/1000*vect1)
                output_curve = gh.PolyLine(pts_sorter(in_curve_pts),True)
                return output_curve
                    
            # Rotation
                    
            def floor_rotate (r_crvs,base_angle):
                angle = 0
                angle1 = 0
                for i in range(len(r_crvs)):
                    if i%2 == 0:
                        angle = angle+base_angle
                    else:
                        angle1 = angle1-base_angle
                    r_crvs[i] = rs.RotateObject(r_crvs[i],rs.CurveAreaCentroid(r_crvs[i])[0],angle,rs.CreateVector(0,0,1),False)
                return r_crvs
            ## TOWER STATICS:
                    
            #Floor Generator
                    
            # Distributing programs (%40 Residential %30 Office %15 Public/Rec %15 Retail)
                    
            for i in range(len(programs)):
                n_ret = int(prg_percentage[0]/100*total_floor_num)
                h_ret = float(prg_heights[0])
                n_ofc = int(prg_percentage[3]/100*total_floor_num)
                h_ofc = float(prg_heights[3])
                n_pub = int(prg_percentage[2]/100*total_floor_num)
                h_pub = float(prg_heights[2])
                n_res = int(prg_percentage[1]/100*total_floor_num)
                h_res = float(prg_heights[1])
                
                if programs[i] == 'retail':
                    index.extend(rndm(num_corners,seed+i))
                    for j in range(len(index)):
                        floor_pts.append(input_pts[index[j]])
                    floor_pts = pts_sorter(floor_pts)
                    temp_floor = gh.PolyLine(floor_pts,True)
                    while (rs.CurveArea(temp_floor)[0] > site_area*(const_perc/100)):
                        print ("Floor Generation Under Progress....")
                        n_rnd = n_rnd+1
                        n = gh.Random(100,1,n_rnd)
                        del index [:]
                        del floor_pts [:]
                        index.extend(rndm(num_corners,seed+n))
                        for j in range(len(index)):
                            floor_pts.append(input_pts[index[j]])
                        floor_pts.append(floor_pts[0])
                        floor_pts = pts_sorter(floor_pts)
                        temp_floor = gh.PolyLine(floor_pts,True) 
                    floor_retail_outlines.append(rs.coercecurve(gh.PolyLine(floor_pts,True)))
                    for i in range(1,n_ret):
                        floor_retail_outlines.append(rs.coercecurve(rs.CopyObject(floor_retail_outlines[0],rs.CreateVector(0,0,i*h_ret))))
                elif programs[i] == 'office':
                    index.extend(rndm(num_corners,seed+i))
                    for j in range(len(index)):
                        floor_pts.append(input_pts[index[j]])
                    floor_pts = pts_sorter(floor_pts)
                    floor_pts.append(floor_pts[0])
                    temp_floor = rs.AddPolyline(floor_pts)
                    n_rnd = 0
                    while (rs.CurveArea(temp_floor)[0] > site_area*(const_perc/100)):
                        print ("Floor Generation Under Progress....")
                        n_rnd = n_rnd+1
                        n = gh.Random(100,1,n_rnd)
                        del index [:]
                        del floor_pts [:]
                        index.extend(rndm(num_corners,seed+n))
                        for j in range(len(index)):
                            floor_pts.append(input_pts[index[j]])
                        floor_pts = pts_sorter(floor_pts)
                        floor_pts.append(floor_pts[0])
                        temp_floor = rs.AddPolyline(floor_pts)
                    floor_office_outlines.append((rs.AddPolyline(floor_pts)))
                    for i in range(1,n_ofc):
                        floor_office_outlines.append(rs.CopyObject(floor_office_outlines[0],rs.CreateVector(0,0,i*h_ofc)))
                elif programs[i] == 'residential':
                    index.extend(rndm(num_corners,seed+i))
                    for j in range(len(index)):
                        floor_pts.append(input_pts[index[j]])
                    floor_pts = pts_sorter(floor_pts)
                    floor_pts.append(floor_pts[0])
                    n_rnd = 0
                    while (rs.CurveArea(temp_floor)[0] > site_area*(const_perc/100)):
                        print ("Floor Generation Under Progress....")
                        n_rnd = n_rnd+1
                        n = gh.Random(100,1,n_rnd)
                        del index [:]
                        del floor_pts [:]
                        index.extend(rndm(num_corners,seed+n))
                        for j in range(len(index)):
                            floor_pts.append(input_pts[index[j]])
                        floor_pts = pts_sorter(floor_pts)
                        floor_pts.append(floor_pts[0])
                        temp_floor = rs.AddPolyline(floor_pts)
                    floor_residential_outlines.append((rs.AddPolyline(floor_pts)))
                    for i in range(1,n_res):
                        floor_residential_outlines.append(rs.CopyObject(floor_residential_outlines[0],rs.CreateVector(0,0,i*h_res)))
                elif programs[i] == 'public':
                    index.extend(rndm(num_corners,seed+i))
                    for j in range(len(index)):
                        floor_pts.append(input_pts[index[j]])
                    floor_pts = pts_sorter(floor_pts)
                    floor_pts.append(floor_pts[0])
                    floor_public_outlines.append((rs.AddPolyline(floor_pts)))
                    for i in range(1,n_pub):
                        floor_public_outlines.append(rs.CopyObject(floor_public_outlines[0],rs.CreateVector(0,0,i*h_pub)))
                else:
                    print("Not a valid program type!")
                    
                    
                    
                    
            index.extend(rndm(7,3))
        
            floor_retail_outlines= rs.coerceguidlist(floor_retail_outlines)
            for i in range(len(floor_retail_outlines)):
                print type(floor_retail_outlines[3])
                floor_retail_outlines[i] = rs.coerceguidlist
            for i in range(len(floor_retail_outlines)):
                floor_retail_outlines[i] = punch(floor_retail_outlines[i],float(force))
                floor_retail_outlines[i] = gh.CleanTree(True,True,True,rs.CurvePoints(gh.FilletDistance(rs.coercecurve(floor_retail_outlines[i]),20)))
                rs.CurveDirectionsMatch(floor_retail_outlines[0],floor_retail_outlines[i])
                    
                    
                    
                    
            for i in range(len(floor_office_outlines)):
                floor_office_outlines[i] = punch(floor_office_outlines[i],float(force))
                floor_office_outlines[i]= rs.AddPolyline(gh.CleanTree(True,True,True,rs.CurvePoints(gh.FilletDistance(rs.coercecurve(floor_office_outlines[i]),20))))
                rs.CurveDirectionsMatch(floor_office_outlines[0],floor_office_outlines[i])
                    
                    
                    
                    
            for i in range(len(floor_residential_outlines)):
                floor_residential_outlines[i] = punch(floor_residential_outlines[i],float(force))
                floor_residential_outlines[i]= rs.AddPolyline(gh.CleanTree(True,True,True,rs.CurvePoints(gh.FilletDistance(rs.coercecurve(floor_residential_outlines[i]),20))))
                rs.CurveDirectionsMatch(floor_residential_outlines[0],floor_residential_outlines[i])
                    
                    
                    
            for i in range(int(n_pub/2)):
                floor_public_outlines[i] = punch(floor_public_outlines[i],float(force))
                rs.CurveDirectionsMatch(floor_public_outlines[0],floor_public_outlines[i])
                floor_publicA_outlines.append(rs.AddPolyline(gh.CleanTree(True,True,True,rs.CurvePoints(gh.FilletDistance(rs.coercecurve(floor_public_outlines[i]),20)))))
                    
                    
            for i in range(int(n_pub/2),len(floor_public_outlines)):
                floor_public_outlines[i] = punch(floor_public_outlines[i],float(force))
                rs.CurveDirectionsMatch(floor_public_outlines[0],floor_public_outlines[i])
                floor_publicB_outlines.append(rs.AddPolyline(gh.CleanTree(True,True,True,rs.CurvePoints(gh.FilletDistance(rs.coercecurve(floor_public_outlines[i]),20)))))
            # Retail
            h1 = int((len(floor_retail_outlines)-1)*h_ret)
            # Retail+PubA
            h2 = int(h1 + (len(floor_publicA_outlines)-1)*h_pub)
            # Retail+PubA+Office
            h3 = int(h2 + (len(floor_office_outlines)-1)*h_ofc)
            h3_b = h3- (len(floor_publicA_outlines))*h_pub
            # Retail+PubA+office+PubB
            h4 = int(h3 + (len(floor_publicB_outlines)-1)*h_pub)
                    
            print (h1,h2,h3,h4)
                    
            rs.MoveObjects(floor_publicA_outlines,rs.CreateVector(0,0,h1))
            rs.MoveObjects(floor_office_outlines,rs.CreateVector(0,0,h2))
            rs.MoveObjects(floor_publicB_outlines,rs.CreateVector(0,0,h3_b))
            rs.MoveObjects(floor_residential_outlines,rs.CreateVector(0,0,h4))
                    
                    
                    
            # Check the centers/ Tower Stability
                    
            ret_c = rs.AddPoint(rs.CurveAreaCentroid(floor_retail_outlines[0])[0][0],rs.CurveAreaCentroid(floor_retail_outlines[0])[0][1],0)
            ofc_c = rs.AddPoint(rs.CurveAreaCentroid(floor_office_outlines[0])[0][0],rs.CurveAreaCentroid(floor_office_outlines[0])[0][1],0)
            res_c = rs.AddPoint(rs.CurveAreaCentroid(floor_residential_outlines[0])[0][0],rs.CurveAreaCentroid(floor_residential_outlines[0])[0][1],0)
            pubA_c = rs.AddPoint(rs.CurveAreaCentroid(floor_publicA_outlines[0])[0][0],rs.CurveAreaCentroid(floor_publicA_outlines[0])[0][1],0)
            pubB_c = rs.AddPoint(rs.CurveAreaCentroid(floor_publicB_outlines[0])[0][0],rs.CurveAreaCentroid(floor_publicB_outlines[0])[0][1],0)
                    
            if rs.Distance(ret_c,ofc_c) > 15:
                rs.MoveObjects(floor_office_outlines,rs.VectorCreate(ret_c,ofc_c))
            if rs.Distance(ret_c,res_c) > 15:
                rs.MoveObjects(floor_residential_outlines,rs.VectorCreate(ret_c,res_c))
            if rs.Distance(ret_c,pubA_c) > 15:
                rs.MoveObjects(floor_publicA_outlines,rs.VectorCreate(ret_c,pubA_c))
            if rs.Distance(ret_c,pubB_c) > 15:
                rs.MoveObjects(floor_publicB_outlines,rs.VectorCreate(ret_c,pubB_c))
                    
                    
            floor_retail_outlines = floor_rotate(floor_retail_outlines,rotation_angle)
            floor_office_outlines = floor_rotate(floor_office_outlines,rotation_angle)
            floor_residential_outlines = floor_rotate(floor_residential_outlines,rotation_angle)
            floor_publicA_outlines = floor_rotate(floor_publicA_outlines,rotation_angle)
            floor_publicB_outlines = floor_rotate(floor_publicB_outlines,rotation_angle)
                    
                    
            ret.extend(floor_retail_outlines)
            ofc.extend(floor_office_outlines)
            res.extend(floor_residential_outlines)
            pub_a.extend(floor_publicA_outlines)
            pub_b.extend(floor_publicB_outlines)
                    
            #Tower: Information
                    
            print("Construction area : ")
            print("Total Sqft : ")
            print '\t'
            print len(floor_retail_outlines)
        else:
            print ("Shhhhhhh! Giraffe is sleeping!")
                
        
        # return outputs if you have them; here I try it for you:
        return (site_area, site_center, immediate_context, floor_pts, ret, ofc, res, pub_a, pub_b)
# ---------- end giraffe ----------
brep = Brep(giraffe.immediate_context)
crv = Curve(giraffe.ret)
crv_2 = Curve(giraffe.ofc)
crv_3 = Curve(giraffe.res)
crv_4 = Curve(giraffe.pub_a)
crv_5 = Curve(giraffe.pub_b)
Z = UnitZ(Factor="-1")
Z_2 = UnitZ(Factor="-1")
Z_3 = UnitZ(Factor="-1")
Z_4 = UnitZ(Factor="-1")
Z_5 = UnitZ(Factor="-1")
extr = Extrude(Base=crv_5, Direction=Z_2)
extr_2 = Extrude(Base=crv_2, Direction=Z_3)
extr_3 = Extrude(Base=crv_4, Direction=Z_4)
extr_4 = Extrude(Base=crv_3, Direction=Z)
extr_5 = Extrude(Base=crv, Direction=Z_5)
cap = CapHoles(Brep=extr)
cap_2 = CapHoles(Brep=extr_5)
cap_3 = CapHoles(Brep=extr_2)
cap_4 = CapHoles(Brep=extr_3)
cap_5 = CapHoles(Brep=extr_4)
