# Grasshopper definition context_punch_v.4.4.20.gh (Grasshopper 1.0.7)
# Copyright: 2019

major_group = ColourSwatch(SwatchColor=RGB(191, 119, 119))
input_component = ColourSwatch(SwatchColor=RGB(169, 191, 119))
output_component = ColourSwatch(SwatchColor=RGB(119, 185, 191))
groups = ColourSwatch(SwatchColor=RGB(255, 255, 255))
force = Slider(11.7, range=0..100)
site = Curve(<curve referenced from the Rhino model>)
context = Brep([<brep referenced from the Rhino model> x8])
context_punch = Context_Punch(site=site, im_context=context, force=force)  # -> out, output_points
pt = Point(context_punch.output_points)
panel = Panel(context_punch.out)

# ==== cluster Context_Punch
site = ClusterInput()
im_context = ClusterInput()
force = ClusterInput()
python = GhPythonScript(site=site, im_context=im_context, force=force)  # -> out, output_points; inputs im_context: list
# ---------- python: Python ----------
__author__ = "milad"
__version__ = "2020.04.04"

import rhinoscriptsyntax as rs
import ghpythonlib.components as gh
import scriptcontext as sc
import random

sc.doc = ghdoc

def context_punch(site,im_context):
    context_centers = []
    unit_vectors=[]
    distances = []
    temp_vectors = []
    temp_distances = []
    moved_points = []
    site = rs.coercegeometry(site)
    input_points = gh.Populate2D(site,100,1)
    for item in im_context:
        item = rs.coercebrep(item)
        center = gh.ConstructPoint(gh.Area(item)[1][0],gh.Area(item)[1][1],0)
        context_centers.append(center)
        for point in input_points:
            temp_vectors.append(gh.Vector2Pt(center,gh.ConstructPoint(point[0],point[1],0),True)[0])
            temp_distances.append(gh.Distance(center,point))
        unit_vectors.append(list(temp_vectors))
        distances.append(list(temp_distances))
        del temp_vectors[:]
        del temp_distances [:]
    move_vector = rs.CreateVector(0,0,0)
    move_quantity = 0
    for i in range(len(input_points)):
        point = input_points[i]
        for j in range (len(im_context)):
            move_vector = move_vector + unit_vectors[j][i]
            move_quantity = max(move_quantity,distances[j][i])
        move_motion = gh.Amplitude(move_vector,(force/100)*move_quantity)
        print ("Move distance:\t {}").format((force/100)*move_quantity)
        moved_point = gh.Move(point,move_motion)[0]
        checker = gh.PointInCurve(moved_point,site)[0]
        if checker ==2:
            moved_points.append(moved_point)
        else:
            moved_points.append(input_points[i])
    return moved_points


output_points = context_punch(site,im_context)
# ---------- end python ----------
out = ClusterOutput(python.out)
output_points = ClusterOutput(python.output_points)
