# Grasshopper definition example.gh (Grasshopper 1.0.7)
# plug-ins: Opossum

v1 = Slider(-5, range=-5..10)
# Opossum comes with two of best performing algorithms in Grasshopper: RBFOpt and CMAES
# 
# RBFOpt should find the optimal value of the test function (0.398) within 50 evaluations, or at least come very close to it.
# CMAES should take around 300 evaluations.
# 
# To find this optimum, Opossum manipulates the number sliders, which represents the function's variables.
# 
# The objective is the result of the function.
# Make sure that your definition always produces a single value!
# 
# RBFOpt's strength is finding close to optimal solutions in 100-300 evaluations (i.e., simulations).
# This high speed of convergence is especially useful for simulations that take a long time.
# 
# CMAES reliably finds near-optimal solutions when you can afford to wait much longer.
# A rule of thumb is to perform number of variables (i.e., number of sliders) + 1 * 100 evaluations.
# 
# CMAES can benefit from a good starting point:
# It can be an effective to use RBFOpt to find a good starting point, and to improve this point with CMAES.
# (If you don’t want to use a starting point, choose “CMAES with random start.”
# 
# The Results tab lets you examine the solutions evaluated during the optimization process by double-clicking on the entries in the table.
# 
# Have fun optimizing, and let us know how it goes!
v2 = Slider(0, range=0..15)
eval_branin = Evaluate(F="(y - (5.1 / (4 * π * π)) * x * x + 5 / π * x - 6)² + 10 * (1 - 1 / (8 * π)) * cos(x) + 10", x=v1, y=v2)
panel = Panel(eval_branin)
surrogate_model_based_optimization = SuMO(fitness=eval_branin, gene=[v1, v2])
